# Grasshopper definition Combined.gh (Grasshopper 0.9.76)
# plug-ins: Python Interpreter, Badger

panel = Panel("Flows")
panel_2 = Panel("Plants")
panel_3 = Panel("Floods")
panel_4 = Panel("Fields")
panel_5 = Panel("Terrain")
year = Slider(2015, range=2015..2115)
get_rel_path = VBScript()  # -> out, File, Folder
# ---------- get_rel_path: C# ----------
    File = "<unset>"
    Folder = "<unset>"

    If (String.IsNullOrEmpty(GrasshopperDocument.FilePath)) Then Return
    
    Try
      File = GrasshopperDocument.FilePath
      Folder = IO.Path.GetDirectoryName(GrasshopperDocument.FilePath) & IO.Path.DirectorySeparatorChar
    Catch
    End Try
# ---------- end get_rel_path ----------

# ---- group: Import CSV relative to current path
concatenate = Concatenate(FragmentA=get_rel_path.Folder, FragmentB="Combined.csv")
read_file = ReadFile(File=concatenate, PerLineParse=True)

# ----
concatenate_2 = Concatenate(FragmentA=get_rel_path.Folder, FragmentB="Combined.csv")
concatenate_3 = Concatenate(FragmentA=get_rel_path.Folder, FragmentB="Combined.csv")
read_file_2 = ReadFile(File=concatenate_2, PerLineParse=True)
read_file_3 = ReadFile(File=concatenate_3, PerLineParse=True)
concatenate_4 = Concatenate(FragmentA=get_rel_path.Folder, FragmentB="Combined.csv")
concatenate_5 = Concatenate(FragmentA=get_rel_path.Folder, FragmentB="Combined.csv")
concatenate_6 = Concatenate(FragmentA=get_rel_path.Folder, FragmentB="Combined.csv")
concatenate_7 = Concatenate(FragmentA=get_rel_path.Folder, FragmentB="Combined.csv")

panel_6 = Panel("CSV & Generic Importer")
species_attribute_importer = SpeciesAttributeImporter(CSVFile=read_file)
generic_species_attributes = GenericSpeciesAttributes()  # -> ShrubP, GrassP, TreeP

panel_7 = Panel("Planting Locations/Time")
curve = Curve(<curve referenced from the Rhino model>)
years = Slider(30, range=0..100)
boundary_surfaces = BoundarySurfaces(Edges=curve)
manual_points = Point([<point referenced from the Rhino model> x12])

geometry_pipeline = GeometryPipeline(
    GroupByLayer=False,
    GroupByType=False,
    IncludeHidden=True,
    IncludeLocked=True,
    LayerFilter="Sediment Retention",
    NameFilter="*",
    TypeFilter=4)
geometry_pipeline_2 = GeometryPipeline(
    GroupByLayer=False,
    GroupByType=False,
    IncludeHidden=True,
    IncludeLocked=True,
    LayerFilter="Visual Area",
    NameFilter="*",
    TypeFilter=4)
geometry_pipeline_3 = GeometryPipeline(
    GroupByLayer=False,
    GroupByType=False,
    IncludeHidden=True,
    IncludeLocked=True,
    LayerFilter="Field Inflow",
    NameFilter="*",
    TypeFilter=4)
geometry_pipeline_4 = GeometryPipeline(
    GroupByLayer=False,
    GroupByType=False,
    IncludeHidden=True,
    IncludeLocked=True,
    LayerFilter="Stream Shading",
    NameFilter="*",
    TypeFilter=4)
read_file_4 = ReadFile(File=concatenate_4, PerLineParse=True)
read_file_5 = ReadFile(File=concatenate_5, PerLineParse=True)
read_file_6 = ReadFile(File=concatenate_6, PerLineParse=True)
read_file_7 = ReadFile(File=concatenate_7, PerLineParse=True)

panel_8 = Panel("Testing Surface/Mesh")
number_slider = Slider(100, range=0..100)
surface = Surface(<surface referenced from the Rhino model>)

panel_9 = Panel("Starting Points")
divide_surface = DivideSurface(Surface=surface, UCount=Slider(7, range=0..10), VCount=Slider(30, range=0..100))  # -> flatten(Points), Normals, Parameters

offset_on_srf = OffsetOnSrf(Curve=geometry_pipeline_4, Distance=1)
read_file_8 = ReadFile(File="C:\Users\s3321811\Dropbox\PhD Work\0 Code\field-tests\Cartography\Field Visualisers\Fields.py", PerLineParse=False)  # -> Content; disabled
#   port File: Uri of file to read
# ---------- read_file_8: VB line parser ----------
    action = GH_LineParserAction.Include
    Return line

    'Parse the line and return some data that represents the line.
    'If the line cannot be parsed, you can return Nothing and
    'assign a different action.
    'The default implementation is to just return the line itself.
    'If you return types that implement IGH_Goo, this component
    'will work substantially faster.
# ---------- end read_file_8 ----------
grid_divisions = Integer(Slider(10, range=0..10))
grid_rectangle = Curve(<curve referenced from the Rhino model>)
number = Number()
regions = Curve([<curve referenced from the Rhino model> x4])
debug = Boolean(True)
plant_placement_solver = PlantPlacementSolver(Plants=species_attribute_importer, Area=boundary_surfaces)  # -> Plants, Locations
plant_placement_solver_2 = PlantPlacementSolver(Plants=generic_species_attributes.ShrubP, Area=boundary_surfaces)  # -> Plants, Locations
c_script = CSharpScript(Bounds=grid_rectangle, Divisions=grid_divisions, Regions=regions)  # -> Out, Field
plant_appearance_simulator = PlantAppearanceSimulator(Plants=species_attribute_importer, Locations=manual_points, Times=years)  # -> Trunk, Root, Crown, Spacing, Color, Label
plant_placement_solver_3 = PlantPlacementSolver(Plants=read_file_7, Area=geometry_pipeline_4)  # -> Plants, Locations
plant_placement_solver_4 = PlantPlacementSolver(Plants=read_file_5, Area=geometry_pipeline)  # -> Plants, Locations
flow_simulation = FlowSimulation(Surface=surface, Points=divide_surface.Points, Fidelity=Slider(100, range=0..100), Jump=100)  # -> Flows, Catchments, FlowEndPoints
plant_placement_solver_5 = PlantPlacementSolver(Plants=read_file_6, Area=geometry_pipeline_3)  # -> Plants, Locations
plant_placement_solver_6 = PlantPlacementSolver(Plants=read_file_4, Area=geometry_pipeline_2)  # -> Plants, Locations
circle = Circle(plant_appearance_simulator.Trunk)
circle_2 = Circle(plant_appearance_simulator.Crown)
circle_3 = Circle(plant_appearance_simulator.Root)
circle_4 = Circle(plant_appearance_simulator.Spacing)
custom_preview = CustomPreview(Geometry=flow_simulation.Flows, Shader=ColourSwatch(SwatchColor=RGB(0, 195, 255)))
custom_preview_2 = CustomPreview(Geometry=flow_simulation.Catchments, Shader=ColourSwatch(SwatchColor=RGB(0, 152, 199)))
text_tag_3d = TextTag3D(Location=manual_points, Size=Slider(141, range=0..1000), Justification=7)
curve_2 = Curve([<curve referenced from the Rhino model> x2])
curve_3 = Curve(<curve referenced from the Rhino model>)
contours = Curve([<curve referenced from the Rhino model> x6])
bounds = Curve(<curve referenced from the Rhino model>)
explode = Explode(Curve=contours, Recursive=True)  # -> Segments, Vertices
unit_z = UnitZ(Factor=Slider(1000, range=0..1000))
contour_check = ContourCheck(Contours=curve_3)
python_script = PythonScript(x=contours)  # -> out, a; inputs x: list
# ---------- python_script: Python ----------
import rhinoscriptsyntax as rs
a = []

if x:
    for item in x:
        d = rs.CurveDegree(item)
        a.append(d)
# ---------- end python_script ----------
c_script_2 = CSharpScript(Contours=curve_3)  # -> out, A; inputs Contours: list of Curve
# ---------- c_script_2: C# ----------
    Print("hello");
    List<Curve> ALL_CONTOURS = Contours;
    List<Curve> fixedContours = new List<Curve>();

    foreach (Curve contour in ALL_CONTOURS)
    {
      int degree = contour.Degree;
      if (contour.IsPolyline()) {

        Print("p");
        Polyline contourPLine;
        contour.TryGetPolyline(out contourPLine); // Convert to Polyline

        List<double> zValues = getZValues(new List<Point3d>(contourPLine.ToArray()));

        if (zValues[0] != zValues[zValues.Count - 1]) {
          // All are the same z-index, no need to do anything
          double medianZ = calculateMean(zValues);

          List<Point3d> newPoints = new List<Point3d>();
          foreach (Point3d point in contourPLine)
          {
            Point3d newPoint = point;
            newPoint.Z = medianZ;
            newPoints.Add(newPoint);
          }

          PolylineCurve fixedPolyline = new PolylineCurve(newPoints);
          fixedContours.Add(fixedPolyline);

        }

      }
      else
      {
        Print("n");
        // TODO: probably shouldn't just assume the curve is nurbs
        NurbsCurve contourNurbsCurve = contour.ToNurbsCurve();

        List<Point3d> pts = new List<Point3d>();
        foreach (ControlPoint ncp in contourNurbsCurve.Points)
        {
          pts.Add(ncp.Location);
        }

        Print("test");
        List<double> zValues = getZValues(pts);
        Print(String.Join("; ", zValues)); 
        
        if (zValues[0] != zValues[zValues.Count - 1])
        {
          Print("nope");
          double medianZ = calculateMean(zValues);



        }

        

      }


    }

    A = fixedContours;
# ---------- c_script_2: C# additional code ----------
  private double calculateMean(List<double> values)
  {
    int count = values.Count;
    Print(count.ToString());
    
    if (count == 0) {
      throw new InvalidOperationException("Empty collection");
    } else if (count % 2 == 0) {
      Print("over 2s");
      Print(values[Convert.ToInt32(count / 2)].ToString());
      return values[Convert.ToInt32(count / 2)]; // Even length return middleish
    } else {
      Print("not over 2s");
      return values[count / 2]; // Odd numbers return exact middle
    }

    return 10;
  }

  private List<double> getZValues(List<Point3d> controlPts)
  {
    List<double> zValues = new List<double>();
    foreach (Point3d point in controlPts)
    {
      zValues.Add(point.Z);
    }
    zValues.Sort();
    return zValues;
  }
# ---------- end c_script_2 ----------
deconstruct = Deconstruct(Point=explode.Vertices)  # -> XComponent, YComponent, ZComponent
extrude = Extrude(Base=bounds, Direction=unit_z)
panel_10 = Panel(c_script_2.out)
get_median = PythonScript(zs=deconstruct.ZComponent)  # -> out, a; inputs zs: list
# ---------- get_median: Python ----------
def median(lst):
    sortedLst = sorted(lst)
    lstLen = len(lst)
    index = (lstLen - 1) // 2

    if (lstLen % 2):
        return sortedLst[index]
    else:
        return (sortedLst[index] + sortedLst[index + 1])/2.0
            

a = median(zs)
# ---------- end get_median ----------
# Set all contours to same Z
construct_point = ConstructPoint(XCoordinate=deconstruct.XComponent, YCoordinate=deconstruct.YComponent, ZCoordinate=get_median.a)
interpolate = Interpolate(Vertices=construct_point, Degree=python_script.a, Periodic=False, KnotStyle=1)  # -> Curve, Length, Domain
curve_4 = Curve(interpolate.Curve)

colour_picker = ColourPicker(PickedColour=RGBA(255, 0, 255, 106))
colour_picker_2 = ColourPicker(PickedColour=RGBA(0, 255, 255, 105))
colour_picker_3 = ColourPicker(PickedColour=RGBA(0, 119, 255, 107))
panel_11 = Panel("Colours")
colour_picker_4 = ColourPicker(PickedColour=RGBA(67, 117, 255, 105))

mean_high_water_springs = Slider(1000, range=0..5000)
mean_low_water_springs = Slider(430, range=0..5000)
mean_high_water_neaps = Slider(1450, range=0..5000)
mean_low_water_neaps = Slider(700, range=0..5000)
mean_sea_level = Slider(0, range=0..5000)
panel_12 = Panel("High Tide Data")

terrain = Brep(<brep referenced from the Rhino model>)
coast = Curve(<curve referenced from the Rhino model>)
panel_13 = Panel("Testing Area")
terrain_2 = Brep(terrain)
frontline = Curve(coast)

sea_level_rise_year = Slider(1.6, range=0..5)
storm_surge_height = Slider(500, range=0..5000)
panel_14 = Panel("Site Data")
sea_datum_z = Slider(0, range=-3000..3000)

frontline_2 = Curve(frontline)
terrain_3 = Brep(terrain_2)

number_2 = Number(sea_datum_z)
number_3 = Number(year)
number_4 = Number(sea_level_rise_year)
number_5 = Number(mean_high_water_springs)
number_6 = Number(mean_low_water_springs)
number_7 = Number(mean_sea_level)
number_8 = Number(mean_high_water_neaps)
number_9 = Number(mean_low_water_neaps)
number_10 = Number(storm_surge_height)

flood_simulator = FloodSimulator(
    Datum=number_2,
    Year=number_3,
    Rise=number_4,
    Surge=number_10,
    HighNeap=number_8,
    LowNeap=number_9,
    HighSpring=number_5,
    LowSpring=number_6)  # -> SeaLevel, StormSurgeLevel, HighNeap, LowNeap, HighSpring, LowSpring

mean_high_water_neap = Geometry(flood_simulator.HighNeap)
mean_high_water_spring = Geometry(flood_simulator.HighSpring)
mean_low_water_spring = Geometry(flood_simulator.LowSpring)
mean_low_water_neap = Geometry(flood_simulator.LowNeap)
mean_sea_level_2 = Geometry(flood_simulator.SeaLevel)
storm_surge_level = Geometry(flood_simulator.StormSurgeLevel)

storm_surge_level_2 = Geometry(storm_surge_level)
mean_high_water_spring_2 = Geometry(mean_high_water_spring)
mean_high_water_neap_2 = Geometry(mean_high_water_neap)
mean_low_water_neap_2 = Geometry(mean_low_water_neap)
mean_low_water_spring_2 = Geometry(mean_low_water_spring)
mean_sea_level_3 = Geometry(mean_sea_level_2)
cluster = Cluster(level=mean_sea_level_3, frontline=frontline_2, terrain=terrain_3)  # -> curve_3, list
cluster_2 = Cluster(level=mean_low_water_neap_2, frontline=frontline_2, terrain=terrain_3)  # -> curve_3, list
cluster_3 = Cluster(level=storm_surge_level_2, frontline=frontline_2, terrain=terrain_3)  # -> curve_3, list
cluster_4 = Cluster(level=mean_high_water_neap_2, frontline=frontline_2, terrain=terrain_3)  # -> curve_3, list
cluster_5 = Cluster(level=mean_low_water_spring_2, frontline=frontline_2, terrain=terrain_3)  # -> curve_3, list
cluster_6 = Cluster(level=mean_high_water_spring_2, frontline=frontline_2, terrain=terrain_3)  # -> curve_3, list
mean_sea_level_srf = CustomPreview(Geometry=cluster.list, Shader=colour_picker_3)
mean_sea_level_srf_2 = CustomPreview(Geometry=cluster_2.list, Shader=colour_picker_3)
mean_sea_level_srf_3 = CustomPreview(Geometry=cluster_4.list, Shader=colour_picker_3)
mean_sea_level_srf_4 = CustomPreview(Geometry=cluster_5.list, Shader=colour_picker_3)
mean_sea_level_srf_5 = CustomPreview(Geometry=cluster_6.list, Shader=colour_picker_3)
mean_sea_level_srf_6 = CustomPreview(Geometry=cluster_3.list, Shader=colour_picker_3)
mean_sea_level_crv = CustomPreview(Geometry=cluster.curve_3, Shader=colour_picker_3)
mean_sea_level_crv_2 = CustomPreview(Geometry=cluster_2.curve_3, Shader=colour_picker_3)
mean_sea_level_crv_3 = CustomPreview(Geometry=cluster_4.curve_3, Shader=colour_picker_3)
mean_sea_level_crv_4 = CustomPreview(Geometry=cluster_5.curve_3, Shader=colour_picker_3)
mean_sea_level_crv_5 = CustomPreview(Geometry=cluster_6.curve_3, Shader=colour_picker_3)
mean_sea_level_crv_6 = CustomPreview(Geometry=cluster_3.curve_3, Shader=colour_picker_3)

# ==== cluster Cluster
level = ClusterInput()
frontline = ClusterInput()
terrain = ClusterInput()
level_2 = Brep(level)
terrain_2 = Brep(terrain)
bbx = BrepBrep(BrepA=terrain_2, BrepB=level_2)  # -> Curves, Points
find_closest = FindClosest(curve=bbx.Curves, curve_2=frontline)
split_with_brep = SplitWithBrep(Curve=level_2, Brep=terrain_2)  # -> Curve, Points
find_closest_2 = FindClosest(curve=split_with_brep.Curve, curve_2=frontline)
curve = Curve(find_closest)
list_item = ListItem(List=find_closest_2, Index=1, Wrap=True)
join_curves = JoinCurves(Curves=[curve, list_item], Preserve=False)
boundary_surfaces = BoundarySurfaces(Edges=join_curves)
list_length = ListLength(List=bbx.Curves)
larger_than = LargerThan(FirstNumber=list_length, SecondNumber=0)  # -> LargerThan, OrEqualTo
cull_pattern = CullPattern(List=boundary_surfaces, CullPattern=larger_than.LargerThan)
curve_2 = Curve(find_closest)
curve_3 = ClusterOutput(curve_2)
list = ClusterOutput(cull_pattern)

# ==== cluster FindClosest
curve = ClusterInput()
curve_2 = ClusterInput()
divide_curve = DivideCurve(Curve=curve_2, Count=2, Kinks=False)  # -> Points, Tangents, Parameters
divide_curve_2 = DivideCurve(Curve=curve, Count=2, Kinks=False)  # -> Points, Tangents, Parameters
list_item = ListItem(List=divide_curve_2.Points, Index=1, Wrap=True)  # -> flatten(Item)
list_item_2 = ListItem(List=divide_curve.Points, Index=1, Wrap=True)
distance = Distance(PointA=list_item, PointB=list_item_2)
sort_list = SortList(Keys=distance)  # -> Keys, ValuesValuesA
list_item_3 = ListItem(List=sort_list.Keys, Index=0, Wrap=True)
member_index = MemberIndex(Set=distance, Member=list_item_3)  # -> Index, Count
list_item_4 = ListItem(List=curve, Index=member_index.Index, Wrap=True)
i = ClusterOutput(list_item_4)
