# Grasshopper definition Groundhog - General Demo.ghx (Grasshopper 1.0.4)
# plug-ins: Groundhog

# ---- group: Global Parameters
# Groundhog Demo File
# Definition prepared for Groundhog v0.6.1a and depends on components from that plugin. It is available for download at http://groundhog.la/
# 
# Contact groundhog@philipbelesky.com for support or feedback
# 
# This is an incomplete/unfinished demonstration file.
# 
# This definition is licensed under the terms of the GPL v3 https://opensource.org/licenses/GPL-3.0
year = Slider(2015, range=2015..2115)
get_rel_path = VBScript()  # -> File, Folder
# ---------- get_rel_path: C# ----------
    File = "<unset>"
    Folder = "<unset>"

    If (String.IsNullOrEmpty(GrasshopperDocument.FilePath)) Then Return

    Try
      File = GrasshopperDocument.FilePath
      Folder = IO.Path.GetDirectoryName(GrasshopperDocument.FilePath) & IO.Path.DirectorySeparatorChar
    Catch
    End Try
# ---------- end get_rel_path ----------
demo_plant_palette = Text("Demo.csv")
panel = Panel(demo_plant_palette)
global_time_parameter = Number(year)
definition_path = Text(get_rel_path.Folder)
sitebounds = Curve(<curve referenced from the Rhino model>)

# ---- group: Navigation Jumps
panel_2 = Panel("Floods")
panel_3 = Panel("Flows")
panel_4 = Panel("Plants")
panel_5 = Panel("Fields")
panel_6 = Panel("Terrain")

# ----
demo_plant_palette_2 = Text(demo_plant_palette)

# ---- group: Terrain Parameters
mesh_reduce_tolerance_for_performance = Slider(0.5, range=0..1)
gap_bridging_tolerance = Slider(7, range=0..10)
createplanes_can_be_slow = BooleanToggle(False)
pipeline = GeometryPipeline(
    GroupByLayer=False,
    GroupByType=False,
    IncludeHidden=True,
    IncludeLocked=True,
    LayerFilter="Contours",
    NameFilter="*",
    TypeFilter=4)
sitebounds_2 = Curve(sitebounds)

# ----
panel_7 = Panel("TERRAIN")

# ---- group: Fixing Contours and Creating the Mesh/Srf
contour_fix = ContourFix(ContourCurves=pipeline)  # -> AllContours, FixedContours
contour_gap_fix = ContourGapFix(ContourCurves=contour_fix.AllContours, Boundary=sitebounds_2, MaximumDistance=gap_bridging_tolerance)  # -> Contours, Joins
contour_clip = ContourClip(ContourCurves=contour_gap_fix.Contours, Boundary=sitebounds_2, CreatePlanarSrfs=createplanes_can_be_slow)  # -> Contours, EdgedContours, PlanarSurfaces
redpline = Reduce(Polyline=contour_clip.EdgedContours, Tolerance=mesh_reduce_tolerance_for_performance)  # -> Polyline, Reduction
cp = ControlPoints(Curve=redpline.Polyline)  # -> flatten(Points), Weights, Knots
remove_overlapping = RemoveOverlapping(pt=cp.Points)
del = DelaunayMesh(Points=remove_overlapping, Plane=PlaneXY(0, 0, 0))
meshterrain = Mesh(del)

# ----
mesh_terrain = CustomPreview(Geometry=del, Shader=ColourSwatch(SwatchColor=RGB(0, 0, 0)))

# ---- group: Basic Mesh Grade Analysis
meshterrain_2 = Mesh(meshterrain)
angle_vector_color = ColourSwatch(SwatchColor=RGB(255, 255, 255))
angle_text = Slider(0.5, range=0..1)
mesh = MeshSlope(Mesh=meshterrain_2)  # -> M, FaceCenters, FaceSlopeVectors, FaceSlopeAngles
gradient = Gradient(
    LowerLimit=0,
    UpperLimit=90,
    Parameter=mesh.FaceSlopeAngles,
    stops=[0: RGB(0, 128, 0), 0.404: RGB(255, 255, 0), 0.799: RGB(255, 0, 0), 1: RGB(0, 0, 0)])
int = Integer(mesh.FaceSlopeAngles)
mesh_2 = Mesh(simplify(graft(mesh.M)))
mcol = MeshColours(Mesh=mesh_2, Colours=simplify(graft(gradient)))
grade_coloring = Mesh(mcol)
angles_vectors = VectorDisplayEx(Point=mesh.FaceCenters, Vector=mesh.FaceSlopeVectors, Colour=angle_vector_color, Width=1)
angles_labels = TextTag3D(Location=mesh.FaceCenters, Text=int, Size=angle_text, Colour=angle_vector_color, Justification=5)

# ----
surfaceterrain = Brep(<brep referenced from the Rhino model>)
panel_8 = Panel("Catchments")

# ---- group: Hydrology Parameters
proximity_threshold = Slider(1, range=0..100)
panel_9 = Panel("Flow Origins")
panel_10 = Panel("Base Surface/Mesh")
fidelity_of_flow_steps = Slider(1, range=0..100)
surface_terrain = Surface(surfaceterrain)
divide_surface = DivideSurface(Surface=surface_terrain, UCount=Slider(60, range=0..100), VCount=Slider(40, range=0..100))  # -> flatten(Points), Normals, Parameters
origins = Point(divide_surface.Points)
surface = Surface(surface_terrain)

# ----
panel_11 = Panel("FLOWS")
proximity_threshold_2 = Number(proximity_threshold)

# ---- group: Flow Path Analysis
surface_2 = Surface(surface)
fidelity = Number(fidelity_of_flow_steps)
origins_2 = Point(origins)
srf_flows = FlowSimulationSurface(Surface=surface_2, Points=origins_2, Fidelity=fidelity, Thread=False)  # -> FlowPoints, FlowPaths
flow_paths = Curve(srf_flows.FlowPaths)
flow_points = Point(srf_flows.FlowPoints)

# ----
# TODO: Use Field Component to build up saturation profile
flow_paths_2 = Curve(flow_paths)

# ---- group: Catchment Analysis
flow_paths_3 = Curve(flow_paths)
proximity_threshold_3 = Number(proximity_threshold_2)
catchments = FlowCatchments(FlowPaths=flatten(flow_paths_3), ProximtyThreshold=proximity_threshold_3)  # -> Catchments, FlowPaths, ColorCodes
catchment_boundaries = Curve(catchments.Catchments)
catchment_colors = Colour(catchments.ColorCodes)
flow_paths_4 = Curve(catchments.FlowPaths)
catchment_boundaries_2 = CustomPreview(Geometry=catchments.Catchments, Shader=catchments.ColorCodes)
catchment_paths = CustomPreview(Geometry=catchments.FlowPaths, Shader=catchments.ColorCodes)

# ---- group: Flow Path Vis
flow_points_2 = Point(flow_points)
lng = ListLength(List=flow_points_2)
series = Series(Start=1, Step=-0.025, Count=lng)
number_slider = Slider(1, range=0..1)
hsl = ColourHSL(Alpha=1, Hue=series, Saturation=series, Luminance=0.5)
flow_paths_hue_shifted_by_distance = CustomPreview(Geometry=flow_points_2, Shader=hsl)

# ----
# TODO: Use Field Component to build up velocityprofile
flow_paths_5 = Curve(flow_paths)
panel_12 = Panel("FLOODS")

sea_level_rise_year = Slider(1.6, range=0..5)
storm_surge_height = Slider(500, range=0..5000)
panel_13 = Panel("Site Data")
sea_datum_z = Slider(0, range=-3000..3000)

mean_high_water_springs = Slider(1000, range=0..5000)
mean_low_water_springs = Slider(430, range=0..5000)
mean_high_water_neaps = Slider(1450, range=0..5000)
mean_low_water_neaps = Slider(700, range=0..5000)
mean_sea_level = Slider(0, range=0..5000)
panel_14 = Panel("High Tide Data")

coast = Curve(<curve referenced from the Rhino model>)
surface_terrain_2 = Brep(surfaceterrain)
panel_15 = Panel("Testing Area")
frontline = Curve(coast)
terrain = Brep(surface_terrain_2)

panel_16 = Panel("TOOO: FIX")
year_2 = Number(global_time_parameter)
terrain_2 = Brep(terrain)
frontline_2 = Curve(frontline)
geometry_pipeline = GeometryPipeline(
    GroupByLayer=False,
    GroupByType=False,
    IncludeHidden=True,
    IncludeLocked=True,
    LayerFilter="Visual Area",
    NameFilter="*",
    TypeFilter=4)
geometry_pipeline_2 = GeometryPipeline(
    GroupByLayer=False,
    GroupByType=False,
    IncludeHidden=True,
    IncludeLocked=True,
    LayerFilter="Sediment Retention",
    NameFilter="*",
    TypeFilter=4)
geometry_pipeline_3 = GeometryPipeline(
    GroupByLayer=False,
    GroupByType=False,
    IncludeHidden=True,
    IncludeLocked=True,
    LayerFilter="Stream Shading",
    NameFilter="*",
    TypeFilter=4)
geometry_pipeline_4 = GeometryPipeline(
    GroupByLayer=False,
    GroupByType=False,
    IncludeHidden=True,
    IncludeLocked=True,
    LayerFilter="Field Inflow",
    NameFilter="*",
    TypeFilter=4)
panel_17 = Panel("PLANTS")
definition_path_2 = Text(definition_path)
demo_plant_palette_3 = Text(demo_plant_palette_2)
concatenate = Concatenate(FragmentA=definition_path_2, FragmentB=demo_plant_palette_3)
read_file = ReadFile(File=concatenate, PerLineParse=True)

# ---- group: Import CSV relative to current path
panel_19 = Panel(panel)
concatenate_2 = Concatenate(FragmentA=definition_path, FragmentB=panel_19)
read_file_2 = ReadFile(File=concatenate_2, PerLineParse=True)

# ----
geometry_pipeline_5 = GeometryPipeline(
    GroupByLayer=False,
    GroupByType=False,
    IncludeHidden=True,
    IncludeLocked=True,
    LayerFilter="Sediment Retention",
    NameFilter="*",
    TypeFilter=4)
plant_placement_solver = PlantPlacementSolver()
plant_placement_solver_2 = PlantPlacementSolver()
plant_placement_solver_3 = PlantPlacementSolver()
plant_placement_solver_4 = PlantPlacementSolver()

panel_20 = Panel("CSV & Generic Importer")
species_attribute_importer = SpeciesAttributeImporter(CSVFile=read_file_2)

sitebounds_3 = Curve(sitebounds)
pop2d = Populate2D(Region=sitebounds_3, Count=100, Seed=1)

curve = Curve(geometry_pipeline_5)
panel_21 = Panel("Planting Locations/Time")
boundary_surfaces = BoundarySurfaces(Edges=curve)
manual_points = Point(pop2d)

generic_species = GenericSpeciesAttributes()  # -> ShrubP, GrassP, TreeP
pimport = SpeciesAttributeImporter(CSVFile=read_file_2)
global_time_parameter_2 = Number(global_time_parameter)
shower = PlantAppearanceSimulator(Plants=species_attribute_importer, Locations=manual_points, Times=global_time_parameter_2)  # -> Trunk, Root, Crown, Spacing, Color, Label

number = Number(sea_datum_z)
number_2 = Number(year_2)
number_3 = Number(mean_high_water_springs)
number_4 = Number(mean_low_water_springs)
number_5 = Number(sea_level_rise_year)
number_6 = Number(mean_sea_level)
number_7 = Number(mean_high_water_neaps)
number_8 = Number(mean_low_water_neaps)
number_9 = Number(storm_surge_height)

flood_simulator = FloodSimulator(
    Datum=number,
    Year=number_2,
    Rise=number_5,
    Surge=number_9,
    HighNeap=number_7,
    LowNeap=number_8,
    HighSpring=number_3,
    LowSpring=number_4)  # -> SeaLevel, StormSurgeLevel, HighNeap, LowNeap, HighSpring, LowSpring

mean_high_water_neap = Geometry(flood_simulator.HighNeap)
mean_high_water_spring = Geometry(flood_simulator.HighSpring)
mean_low_water_spring = Geometry(flood_simulator.LowSpring)
mean_sea_level_2 = Geometry(flood_simulator.SeaLevel)
mean_low_water_neap = Geometry(flood_simulator.LowNeap)
storm_surge_level = Geometry(flood_simulator.StormSurgeLevel)

storm_surge_level_2 = Geometry(storm_surge_level)
mean_sea_level_3 = Geometry(mean_sea_level_2)
mean_low_water_neap_2 = Geometry(mean_low_water_neap)
mean_high_water_neap_2 = Geometry(mean_high_water_neap)
mean_high_water_spring_2 = Geometry(mean_high_water_spring)
mean_low_water_spring_2 = Geometry(mean_low_water_spring)
cluster = Cluster(level=mean_sea_level_3, frontline=frontline_2, terrain=terrain_2)  # -> curve_3, list
cluster_2 = Cluster(level=mean_low_water_neap_2, frontline=frontline_2, terrain=terrain_2)  # -> curve_3, list
cluster_3 = Cluster(level=storm_surge_level_2, frontline=frontline_2, terrain=terrain_2)  # -> curve_3, list
cluster_4 = Cluster(level=mean_high_water_neap_2, frontline=frontline_2, terrain=terrain_2)  # -> curve_3, list
cluster_5 = Cluster(level=mean_low_water_spring_2, frontline=frontline_2, terrain=terrain_2)  # -> curve_3, list
cluster_6 = Cluster(level=mean_high_water_spring_2, frontline=frontline_2, terrain=terrain_2)  # -> curve_3, list
mean_sea_level_srf = CustomPreview(
    Geometry=cluster.list,
    Shader={ambient=RGB(0, 0, 0), diffuse=RGB(255, 105, 180), emission=RGB(76, 32, 54), shine=0.5, specular=RGB(255, 255, 255), transparency=0})
mean_sea_level_srf_2 = CustomPreview(
    Geometry=cluster_2.list,
    Shader={ambient=RGB(0, 0, 0), diffuse=RGB(255, 105, 180), emission=RGB(76, 32, 54), shine=0.5, specular=RGB(255, 255, 255), transparency=0})
mean_sea_level_srf_3 = CustomPreview(
    Geometry=cluster_4.list,
    Shader={ambient=RGB(0, 0, 0), diffuse=RGB(255, 105, 180), emission=RGB(76, 32, 54), shine=0.5, specular=RGB(255, 255, 255), transparency=0})
mean_sea_level_srf_4 = CustomPreview(
    Geometry=cluster_5.list,
    Shader={ambient=RGB(0, 0, 0), diffuse=RGB(255, 105, 180), emission=RGB(76, 32, 54), shine=0.5, specular=RGB(255, 255, 255), transparency=0})
mean_sea_level_srf_5 = CustomPreview(
    Geometry=cluster_6.list,
    Shader={ambient=RGB(0, 0, 0), diffuse=RGB(255, 105, 180), emission=RGB(76, 32, 54), shine=0.5, specular=RGB(255, 255, 255), transparency=0})
mean_sea_level_srf_6 = CustomPreview(
    Geometry=cluster_3.list,
    Shader={ambient=RGB(0, 0, 0), diffuse=RGB(255, 105, 180), emission=RGB(76, 32, 54), shine=0.5, specular=RGB(255, 255, 255), transparency=0})
mean_sea_level_crv = CustomPreview(
    Geometry=cluster.curve_3,
    Shader={ambient=RGB(0, 0, 0), diffuse=RGB(255, 105, 180), emission=RGB(76, 32, 54), shine=0.5, specular=RGB(255, 255, 255), transparency=0})
mean_sea_level_crv_2 = CustomPreview(
    Geometry=cluster_2.curve_3,
    Shader={ambient=RGB(0, 0, 0), diffuse=RGB(255, 105, 180), emission=RGB(76, 32, 54), shine=0.5, specular=RGB(255, 255, 255), transparency=0})
mean_sea_level_crv_3 = CustomPreview(
    Geometry=cluster_4.curve_3,
    Shader={ambient=RGB(0, 0, 0), diffuse=RGB(255, 105, 180), emission=RGB(76, 32, 54), shine=0.5, specular=RGB(255, 255, 255), transparency=0})
mean_sea_level_crv_4 = CustomPreview(
    Geometry=cluster_5.curve_3,
    Shader={ambient=RGB(0, 0, 0), diffuse=RGB(255, 105, 180), emission=RGB(76, 32, 54), shine=0.5, specular=RGB(255, 255, 255), transparency=0})
mean_sea_level_crv_5 = CustomPreview(
    Geometry=cluster_6.curve_3,
    Shader={ambient=RGB(0, 0, 0), diffuse=RGB(255, 105, 180), emission=RGB(76, 32, 54), shine=0.5, specular=RGB(255, 255, 255), transparency=0})
mean_sea_level_crv_6 = CustomPreview(
    Geometry=cluster_3.curve_3,
    Shader={ambient=RGB(0, 0, 0), diffuse=RGB(255, 105, 180), emission=RGB(76, 32, 54), shine=0.5, specular=RGB(255, 255, 255), transparency=0})

# ==== cluster Cluster
level = ClusterInput()
frontline = ClusterInput()
terrain = ClusterInput()
level_2 = Brep(level)
terrain_2 = Brep(terrain)
bbx = BrepBrep(BrepA=terrain_2, BrepB=level_2)  # -> Curves, Points
find_closest = FindClosest(curve=bbx.Curves, curve_2=frontline)
split_with_brep = SplitWithBrep(Curve=level_2, Brep=terrain_2)  # -> Curve, Points
curve = Curve(find_closest)
find_closest_2 = FindClosest(curve=split_with_brep.Curve, curve_2=frontline)
list_item = ListItem(List=find_closest_2, Index=1, Wrap=True)
join_curves = JoinCurves(Curves=[curve, list_item], Preserve=False)
list_length = ListLength(List=bbx.Curves)
boundary_surfaces = BoundarySurfaces(Edges=join_curves)
larger_than = LargerThan(FirstNumber=list_length, SecondNumber=0)  # -> LargerThan, OrEqualTo
cull_pattern = CullPattern(List=boundary_surfaces, CullPattern=larger_than.LargerThan)
curve_2 = Curve(find_closest)
curve_3 = ClusterOutput(curve_2)
list = ClusterOutput(cull_pattern)

# ==== cluster RemoveOverlapping
pt = ClusterInput()
pt_2 = Point(pt)
sort_pt = SortPoints(Points=pt_2)  # -> Points, Indices
shift = ShiftList(List=sort_pt.Points, Shift=1, Wrap=True)
pdecon = Deconstruct(Point=sort_pt.Points)  # -> XComponent, YComponent, ZComponent
pdecon_2 = Deconstruct(Point=shift)  # -> XComponent, YComponent, ZComponent
equals = Equality(FirstNumber=pdecon.YComponent, SecondNumber=pdecon_2.YComponent)  # -> Equality, Inequality
equals_2 = Equality(FirstNumber=pdecon.XComponent, SecondNumber=pdecon_2.XComponent)  # -> Equality, Inequality
and = GateAnd(A=equals_2.Equality, B=equals.Equality)
equals_3 = Equality(FirstNumber=and, SecondNumber=0)  # -> Equality, Inequality
cull = CullPattern(List=sort_pt.Points, CullPattern=equals_3.Equality)
pt_3 = Point(cull)
pt_4 = ClusterOutput(pt_3)

# ==== cluster FindClosest
curve = ClusterInput()
curve_2 = ClusterInput()
divide_curve = DivideCurve(Curve=curve_2, Count=2, Kinks=False)  # -> Points, Tangents, Parameters
divide_curve_2 = DivideCurve(Curve=curve, Count=2, Kinks=False)  # -> Points, Tangents, Parameters
list_item = ListItem(List=divide_curve_2.Points, Index=1, Wrap=True)  # -> flatten(Item)
list_item_2 = ListItem(List=divide_curve.Points, Index=1, Wrap=True)
distance = Distance(PointA=list_item, PointB=list_item_2)
sort_list = SortList(Keys=distance)  # -> Keys, ValuesValuesA
list_item_3 = ListItem(List=sort_list.Keys, Index=0, Wrap=True)
member_index = MemberIndex(Set=distance, Member=list_item_3)  # -> Index, Count
list_item_4 = ListItem(List=curve, Index=member_index.Index, Wrap=True)
i = ClusterOutput(list_item_4)
