# Grasshopper definition Groundhog - Fields Examples.ghx (Grasshopper 0.9.76)
# plug-ins: Groundhog

desired_domain_start = Slider(25, range=0..100)
desired_domain_end = Slider(50, range=0..100)
curve = Curve(<curve referenced from the Rhino model>)

# ----
# Groundhog Example File
# Definition prepared for Groundhog v0.7.0b and depends on components from that plugin. It is available for download at http://groundhog.la/
# 
# Contact groundhog@philipbelesky.com for support or feedback.
# 
# This is an example file related to the plugin's documentation.
# 
# This definition is licensed under the terms of the GPL v3 https://opensource.org/licenses/GPL-3.0
number_slider = Slider(50, range=0..100)
curve_2 = Curve(<curve referenced from the Rhino model>)
curve_3 = Curve([<curve referenced from the Rhino model> x9])

# ---- group: Translate geometry to field
field_mapper = FieldMapper(Bounds=curve_2, Divisions=number_slider, Areas=curve_3, ZRange=0)

# ---- group: Translate field to grid visualisation
field_grid = FieldVisualisationGrid(Field=field_mapper, Bounds=curve, DomainStart=desired_domain_start, DomainEnd=desired_domain_end)  # -> Points, Parameters
field_grid_2 = FieldVisualisationGrid(Field=field_mapper, Bounds=curve, DomainStart=0, DomainEnd=1)  # -> Points, Parameters
gradient = Gradient(
    LowerLimit=0,
    UpperLimit=1,
    Parameter=field_grid_2.Parameters,
    stops=[0: RGB(0, 128, 0), 0.5: RGB(255, 255, 0), 1: RGB(255, 0, 0)])
circle = CircleCNR(Center=field_grid.Points, Normal=Vector(0, 0, 1), Radius=field_grid.Parameters)
preview = CustomPreview(Geometry=circle, Shader=gradient)
