# Grasshopper definition Groundhog - Flow Saturation Examples.ghx (Grasshopper 1.0.7)
# plug-ins: Groundhog

volume_lost_per_segment = Slider(0.05, range=0..0.1)
flow_volume_per_path = Slider(100, range=0..1000)
# Example 1 (Lower-Left)
u_count = Slider(20, range=0..50)
v_count = Slider(20, range=0..50)
grid_fidelity = Slider(25, range=0..100)
flow_fidelity = Slider(100, range=0..100)

flow_fidelity_2 = Slider(100, range=0..100)
# Example 1 (Upper-Left)
u_count_2 = Slider(20, range=0..50)
v_count_2 = Slider(20, range=0..50)
grid_fidelity_2 = Slider(25, range=0..100)

# ---- group: Base Surface
# Groundhog Example File
# Definition prepared for Groundhog v0.11.1b and depends on components from that plugin. It is available for download at http://groundhog.la/
# 
# Contact groundhog@philipbelesky.com for support or feedback.
# 
# This is an example file related to the plugin's documentation.
surface = Surface(<surface referenced from the Rhino model>)

surface_2 = Surface(<surface referenced from the Rhino model>)

# ---- group: Create point grid for path starts
divide_surface = DivideSurface(Surface=surface_2, UCount=u_count, VCount=v_count)  # -> flatten(Points), Normals, Parameters

# ---- group: Make surface into a quad mesh for more even analytic overlay
mesh_surface = MeshSurface(Surface=surface, UCount=grid_fidelity_2, VCount=grid_fidelity_2, Overhang=True, Equalize=False)

# ---- group: Create point grid for path starts
divide_surface_2 = DivideSurface(Surface=surface, UCount=u_count_2, VCount=v_count_2)  # -> flatten(Points), Normals, Parameters

# ---- group: Make surface into a quad mesh for more even analytic overlay
mesh_surface_2 = MeshSurface(Surface=surface_2, UCount=grid_fidelity, VCount=grid_fidelity, Overhang=True, Equalize=False)

# ---- group: Calculate the flow paths (for surface)
flow_projection_surface = FlowProjectionSurface(Surface=surface_2, Points=divide_surface.Points, Fidelity=flow_fidelity, Steps=0, Thread=False)  # -> FlowPoints, FlowPaths

flow_projection_surface_2 = FlowProjectionSurface(Surface=surface, Points=divide_surface_2.Points, Fidelity=flow_fidelity_2, Steps=0, Thread=False)  # -> FlowPoints, FlowPaths

# ---- group: Calculate the flow path saturations
flow_saturation = FlowSaturation(Mesh=mesh_surface, FlowPaths=flow_projection_surface_2.FlowPaths)  # -> FlowOverlaps, FlowVolumes, MeshFaces, FaceCenters

# ----
flow_saturation_2 = FlowSaturation(
    Mesh=mesh_surface_2,
    FlowPaths=flow_projection_surface.FlowPaths,
    StartVolume=flow_volume_per_path,
    SegmentLoss=volume_lost_per_segment)  # -> FlowOverlaps, FlowVolumes, MeshFaces, FaceCenters

# ---- group: Color the surface with the flow volume result
flow_volumes = Number(flow_saturation.FlowVolumes)
mesh_faces = Mesh(flow_saturation.MeshFaces)
upper_clamp = Slider(456, range=0..1000)
flow_paths = Curve(flow_projection_surface_2.FlowPaths)
unit_z = UnitZ(Factor=5)
bounds = Bounds(Numbers=flow_volumes)
gradient = Gradient(LowerLimit=0, UpperLimit=upper_clamp, Parameter=flow_volumes, stops=[0: RGB(255, 0, 255), 1: RGB(0, 169, 255)])
move = Move(Geometry=flow_paths, Motion=unit_z)  # -> Geometry, Transform
panel = Panel(bounds)
mesh_colours = MeshColours(Mesh=simplify(graft(mesh_faces)), Colours=simplify(graft(gradient)))
custom_preview = CustomPreview(Geometry=move.Geometry, Material=ColourSwatch(SwatchColor=RGB(255, 255, 255)))

# ---- group: Label locations with volumes
flow_volumes_2 = Number(flow_saturation_2.FlowVolumes)
offset = Slider(25, range=0..50)
face_centers = Point(flow_saturation_2.FaceCenters)
concatenate = Concatenate(FragmentA=flow_volumes_2, FragmentB="L")
vector_xyz = VectorXYZ(XComponent=offset, YComponent=offset, ZComponent=0)  # -> Vector, Length
move_2 = Move(Geometry=face_centers, Motion=vector_xyz.Vector)  # -> Geometry, Transform
text_size = Slider(25, range=0..100)
text_tag_3d = TextTag3D(
    Location=move_2.Geometry,
    Text=concatenate,
    Size=text_size,
    Colour=ColourSwatch(SwatchColor=RGB(255, 255, 255)),
    Justification=7)

# ---- group: Show water volumes as cylinders of variable height
max_height = Slider(1000, range=0..1000)
min_height = Slider(5, range=0..50)
radius = Slider(25, range=0..50)
flow_volumes_3 = Number(flow_saturation_2.FlowVolumes)
face_centers_2 = Point(flow_saturation_2.FaceCenters)
bounds_2 = Bounds(Numbers=flow_volumes_3)
construct_domain = ConstructDomain(DomainStart=min_height, DomainEnd=max_height)
remap_numbers = RemapNumbers(Value=flow_volumes_3, Source=bounds_2, Target=construct_domain)  # -> Mapped, Clipped
cylinder = Cylinder(Base=face_centers_2, Radius=radius, Length=remap_numbers.Mapped)
custom_preview_2 = CustomPreview(Geometry=cylinder, Material=ColourSwatch(SwatchColor=RGB(0, 57, 255)))
