# Grasshopper definition Groundhog - Flows Examples.ghx (Grasshopper 1.0.7)
# plug-ins: Groundhog

flow_step_size = Slider(25, range=0..100)
# Example 2 (Center)
random_points_count = Slider(300, range=0..1000)
flow_step_limit = Slider(75, range=0..100)
multithread = BooleanToggle(True)

# ----
# Example 3 (Right)
flow_step_size_2 = Slider(50, range=0..100)
pipe_radius = Slider(25, range=0..25)
pipe_divisons = Slider(5, range=0..15)
geometry_pipeline = GeometryPipeline(
    GroupByLayer=False,
    GroupByType=False,
    IncludeHidden=True,
    IncludeLocked=True,
    LayerFilter="Manual Points",
    NameFilter="*",
    SublayerFiltering=True,
    TypeFilter=1)

# ----
# Example 1 (Left)
u_count = Slider(20, range=0..50)
v_count = Slider(20, range=0..50)

geometry_pipeline_2 = GeometryPipeline(
    GroupByLayer=False,
    GroupByType=False,
    IncludeHidden=True,
    IncludeLocked=True,
    LayerFilter="Manual Pits",
    NameFilter="*",
    SublayerFiltering=True,
    TypeFilter=4)

# ---- group: Base Mesh
mesh = Mesh(<mesh referenced from the Rhino model>)

mesh_2 = Mesh(<mesh referenced from the Rhino model>)

# ---- group: Base Surface
# Groundhog Example File
# Definition prepared for Groundhog v0.12.0b and depends on components from that plugin. It is available for download at http://groundhog.la/
# 
# Contact groundhog@philipbelesky.com for support or feedback.
# 
# This is an example file related to the plugin's documentation.
surface = Surface(<surface referenced from the Rhino model>)

# ---- group: Create point grid for path starts
divide_surface = DivideSurface(Surface=surface, UCount=u_count, VCount=v_count)  # -> flatten(Points), Normals, Parameters

# ---- group: Create point sources for path starts
circle_cnr = CircleCNR(Center=geometry_pipeline, Normal=Vector(0, 0, 1), Radius=pipe_radius)
divide_curve = DivideCurve(Curve=circle_cnr, Count=pipe_divisons, Kinks=False)  # -> flatten(Points), Tangents, Parameters

# ---- group: Distribute points randomly on mesh for path starts
cluster = Cluster(C=mesh_2, N=random_points_count)

# ---- group: Calculate the flow paths (for surface)
flow_projection_surface = FlowProjectionSurface(Surface=surface, Points=divide_surface.Points, Fidelity=0, Steps=0, Thread=False)  # -> FlowPoints, FlowPaths

# ---- group: Calculate the flow paths (for mesh)
flow_projection_mesh = FlowSimulationMesh(Mesh=mesh_2, Points=cluster, Fidelity=flow_step_size, Steps=flow_step_limit, Thread=multithread)  # -> FlowPoints, FlowPaths

flow_projection_mesh_2 = FlowProjectionMesh(Mesh=mesh, Points=divide_curve.Points, Jump=flow_step_size_2, Steps=0, Thread=False)  # -> FlowPoints, FlowPaths

# ---- group: Extrude drains to encompass all flow paths
Z = Slider(500, range=0..1000)
drains = Curve(geometry_pipeline_2)
unit_z = UnitZ(Factor=Z)
extrude = Extrude(Base=drains, Direction=unit_z)
cap_holes = CapHoles(Brep=extrude)

# ---- group: Create and color a naïve flooding extents from end points
pooling_radius = Slider(481, range=0..3000)
sampling_accuracy = Slider(10, range=0..1000)
flow_paths = Data(flow_projection_mesh.FlowPaths)
end_points = EndPoints(Curve=flow_paths)  # -> Start, End
deconstruct = Deconstruct(Point=end_points.End)  # -> XComponent, YComponent, ZComponent
construct_point = ConstructPoint(XCoordinate=deconstruct.XComponent, YCoordinate=deconstruct.YComponent, ZCoordinate=0)
list_length = ListLength(List=construct_point)
repeat_data = RepeatData(Data=pooling_radius, Length=list_length)
metaball_t_custom = MetaBallTCustom(Points=construct_point, Charge=repeat_data, Plane=PlaneXY(0, 0, 0), Threshold=0.5, Accuracy=sampling_accuracy)
simplify_curve = SimplifyCurve(Curve=metaball_t_custom, Tolerance=5, AngleTolerance=1)  # -> Curve, Simplified
pooling_color = ColourSwatch(SwatchColor=RGBA(255, 255, 255, 153))
boundary_surfaces = BoundarySurfaces(Edges=simplify_curve.Curve)
custom_preview = CustomPreview(Geometry=boundary_surfaces, Shader=pooling_color)

# ---- group: Color flow paths by length from source
minimum_luminance = Slider(0, range=0..1)
luminance_step = Slider(-0.02, range=-1..0.1)
flow_paths_2 = Data(flow_projection_surface.FlowPaths)
explode = Explode(Curve=flow_paths_2, Recursive=True)  # -> Segments, Vertices
list_length_2 = ListLength(List=explode.Segments)
series = Series(Start=1, Step=luminance_step, Count=list_length_2)
maximum = Maximum(A=series, B=minimum_luminance)
colour_hsl = ColourHSL(Alpha=1, Hue=0.5, Saturation=1, Luminance=maximum)
custom_preview_2 = CustomPreview(Geometry=explode.Segments, Shader=colour_hsl)

# ---- group: Split flow paths if they intersect with drain areas
flow_paths_3 = Data(flow_projection_mesh_2.FlowPaths)
split_with_breps = SplitWithBreps(Curve=flow_paths_3, Brep=cap_holes)  # -> Curve, Points
list_length_3 = ListLength(List=split_with_breps.Curve)
list_item = ListItem(List=split_with_breps.Curve, Index=0, Wrap=True)
equality = Equality(FirstNumber=list_length_3, SecondNumber=0)  # -> Equality, Inequality
cull_pattern = CullPattern(List=graft(flow_paths_3), CullPattern=equality.Equality)
undrained_paths = Curve(cull_pattern)
drained_paths = Curve(list_item)

# ---- group: Display flow paths as series of vectors
flow_paths_4 = Data([drained_paths, undrained_paths])
explode_2 = Explode(Curve=flow_paths_4, Recursive=True)  # -> Segments, Vertices
shift_list = ShiftList(List=explode_2.Vertices, Shift=1, Wrap=False)
vector_2pt = Vector2Pt(PointA=explode_2.Vertices, PointB=shift_list, Unitize=False)  # -> Vector, Length
vector_display_ex = VectorDisplayEx(Point=explode_2.Vertices, Vector=vector_2pt.Vector, Colour=ColourSwatch(SwatchColor=RGB(0, 208, 255)), Width=3)

# ----
pooling_color_2 = ColourSwatch(SwatchColor=RGB(255, 255, 255))
custom_preview_3 = CustomPreview(Geometry=flow_projection_mesh.FlowPaths, Shader=pooling_color_2)

# ---- group: Display pit drain
drains_2 = Curve(geometry_pipeline_2)
end_points_2 = EndPoints(Curve=drained_paths)  # -> Start, flatten(End)
area = Area(Geometry=drains_2)  # -> Area, Centroid
closest_point = ClosestPoint(Point=end_points_2.End, Cloud=area.Centroid)  # -> ClosestPoint, CPIndex, Distance
line = Line(StartPoint=end_points_2.End, EndPoint=closest_point.ClosestPoint)

# ----
dash_pattern = DashPattern(Curve=line, Pattern=14.14213562)  # -> Dashes, Gaps

# ---- group: Display pit drain (continued)
custom_preview_4 = CustomPreview(Geometry=[dash_pattern.Dashes, area.Centroid], Material=ColourSwatch(SwatchColor=RGB(213, 0, 255)))

# ==== cluster Cluster
N = ClusterInput()
C = ClusterInput()
bbox = BoundingBox(Content=C, Plane=PlaneXY(0, 0, 0))  # -> Box, Box_2
debrep = DeconstructBrep(Brep=bbox.Box)  # -> Faces, Edges, Vertices
item = ListItem(List=debrep.Faces, Index=Slider(5, range=0..10), Wrap=True)
pop2d = Populate2D(Region=item, Count=N, Seed=1)
volume = Volume(Geometry=bbox.Box)  # -> Volume, Centroid
area = Area(Geometry=item)  # -> Area, Centroid
vector_2pt = Vector2Pt(PointA=area.Centroid, PointB=volume.Centroid, Unitize=False)  # -> Vector, Length
deconstruct_vector = DeconstructVector(Vector=vector_2pt.Vector)  # -> XComponent, YComponent, ZComponent
unit_z = UnitZ(Factor=deconstruct_vector.ZComponent)
project = ProjectPoint(Point=pop2d, Direction=unit_z, Geometry=C)  # -> Point, Index
P = ClusterOutput(project.Point)
