# Grasshopper definition Groundhog - Plants Examples.ghx (Grasshopper 0.9.76)
# plug-ins: Groundhog

# ---- group: Normally you would import the a CSV but on OSX file importing does not work in the current Rhino WIP
# Groundhog Example File
# Definition prepared for Groundhog v0.7.0b and depends on components from that plugin. It is available for download at http://groundhog.la/
# 
# Contact groundhog@philipbelesky.com for support or feedback.
# 
# This is an example file related to the plugin's documentation.
# 
# This definition is licensed under the terms of the GPL v3 https://opensource.org/licenses/GPL-3.0
species_attributes = Panel("""Species Name,Common Name,Indigenous Name,Time to Maturity,Spacing Radius,Initial Crown Radius,Mature Crown Radius,Crown Variance,Initial Trunk Radius,Mature Trunk Radius,Trunk Variance, Initial Height,Mature Height, Height Variance, Initial Root Radius,Mature Root Radius, Root Variance,Display R,Display G,Display B
Rhopalostylis sapida,Nikau,Nikau,25,750,500,3000,15,75,200,15,500,12500,15,150,2500,15,16,148,59
Cordyline australis,Cabbage Tree,Ti Kouka,50,750,500,1500,25,100,250,25,1000,16000,25,200,1750,25,26,171,23
Phorium Tenax,NZ Flax,Harakeke,20,450,300,2000,20,50,175,20,300,3000,20,100,1500,20,110,171,23
Kunzea ericoides,White tea-tree,Kanuka,12,750,500,3000,30,100,250,20,500,6000,20,200,1850,20,130,201,54
Metrosideros excelsa,Pohutukawa,Pohutukawa,40,750,500,1500,20,75,350,20,500,20000,20,150,1100,20,17,198,98
Podocarpus totara,Totara,Totara,30,800,800,1600,33,110,350,30,500,22000,30,220,1200,30,17,198,43""")
pimport = SpeciesAttributeImporter(CSVFile=species_attributes)
species = Data(pimport)

# ---- group: File import option (for windows)
path = FilePath("C:\Users\Philip\Documents\groundhog\examples\Plants Examples.csv")
file = ReadFile(File=path, PerLineParse=True)
pimport_2 = SpeciesAttributeImporter(CSVFile=file)
species_2 = Data(pimport_2)

# ----
x_years = Slider(5, range=0..50)
global_time_parameter = Number(x_years)

# ---- group: Area(s) to be Planted (imported from layers)
geometry_pipeline = GeometryPipeline(
    GroupByLayer=False,
    GroupByType=False,
    IncludeHidden=True,
    IncludeLocked=True,
    LayerFilter="Stream Shading",
    NameFilter="*",
    TypeFilter=4)
geometry_pipeline_2 = GeometryPipeline(
    GroupByLayer=False,
    GroupByType=False,
    IncludeHidden=True,
    IncludeLocked=True,
    LayerFilter="Sediment Retention",
    NameFilter="*",
    TypeFilter=4)
geometry_pipeline_3 = GeometryPipeline(
    GroupByLayer=False,
    GroupByType=False,
    IncludeHidden=True,
    IncludeLocked=True,
    LayerFilter="Visual Area",
    NameFilter="*",
    TypeFilter=4)
geometry_pipeline_4 = GeometryPipeline(
    GroupByLayer=False,
    GroupByType=False,
    IncludeHidden=True,
    IncludeLocked=True,
    LayerFilter="Field Inflow",
    NameFilter="*",
    TypeFilter=4)
sediment_retention = Curve(geometry_pipeline_2)
stream_shading = Curve(geometry_pipeline)
field_inflow = Curve(geometry_pipeline_4)
visual_area = Curve(geometry_pipeline_3)

# ---- group: Generic Species types
generic_species = GenericSpeciesAttributes()  # -> ShrubP, GrassP, TreeP
species_3 = Data(generic_species.ShrubP)
species_4 = Data(generic_species.GrassP)
species_5 = Data(generic_species.TreeP)

# ---- group: Create grid based placement
plant_per_uv_span_1m2 = Slider(25, range=0..50)
crv = Curve(field_inflow)
cluster = Cluster(C=crv, B=plant_per_uv_span_1m2, B_2=plant_per_uv_span_1m2)
pt = Point(cluster)

# ---- group: Create random based distribution
plant_per_1m2 = Slider(10, range=0..100)
crv_2 = Curve(visual_area)
cluster_2 = Cluster_2(C=crv_2, B=plant_per_1m2)
pt_2 = Point(cluster_2)

# ---- group: Repeat data to match planted points (match 50/50)
lng = ListLength(List=pt)
division = Division(A=lng, B=2)
repeat = RepeatData(Data=species_4, Length=division)
repeat_2 = RepeatData(Data=species_5, Length=division)
data = Data([repeat, repeat_2])

# ---- group: Repeat data to match planted points
lng_2 = ListLength(List=pt_2)
repeat_3 = RepeatData(Data=species_3, Length=lng_2)

# ----
pt_3 = Point(pt)
pt_4 = Point(pt_2)
shower = PlantAppearanceSimulator(Plants=repeat_3, Locations=pt_4, Times=global_time_parameter)  # -> Trunk, Root, Crown, Spacing, Color, Label
shower_2 = PlantAppearanceSimulator(Plants=data, Locations=pt_3, Times=global_time_parameter)  # -> Trunk, Root, Crown, Spacing, Color, Label

# ---- group: Visualise crowns + tag species
darc = DeconstructArc(Arc=shower_2.Crown)  # -> BasePlane, Radius, Angle
preview = CustomPreview(Geometry=shower_2.Crown, Shader=shower_2.Color)
tag = TextTag(Location=darc.BasePlane, Text=shower_2.Label, Colour=shower_2.Color)

# ---- group: Visualised crowns + tag species
darc_2 = DeconstructArc(Arc=shower.Crown)  # -> BasePlane, Radius, Angle
preview_2 = CustomPreview(Geometry=shower.Crown, Shader=shower.Color)
tag_2 = TextTag(Location=darc_2.BasePlane, Text=shower.Label, Colour=shower.Color)

# ---- group: Species proportions
txt = Text(flatten(shower.Label))
txt_2 = Text(flatten(shower_2.Label))
pie = PieChart([txt_2, txt])

# ==== cluster Cluster
C = ClusterInput()
bbox = BoundingBox(Content=C, Plane=PlaneXY(0, 0, 0))  # -> Box, Box_2
debrep = DeconstructBrep(Brep=bbox.Box)  # -> Faces, Edges, Vertices
B = ClusterInput()
B_2 = ClusterInput()
item = ListItem(List=debrep.Faces, Index=0, Wrap=True)  # -> simplify(Item)
item_2 = ListItem(List=debrep.Edges, Index=0, Wrap=True)
item_3 = ListItem(List=debrep.Edges, Index=Slider(1, range=0..1), Wrap=True)
len = Length(Curve=item_2)
len_2 = Length(Curve=item_3)
division = Division(A=len, B=100)
division_2 = Division(A=len_2, B=100)
division_3 = Division(A=division, B=B)
division_4 = Division(A=division_2, B=B_2)
sdivide = DivideSurface(Surface=item, UCount=division_3, VCount=division_4)  # -> Points, Normals, Parameters
join = JoinCurves(Curves=C, Preserve=False)
trim = TrimTree(Tree=sdivide.Points, Depth=1)
incurve = PointInCurve(Point=trim, Curve=graft(join))  # -> Relationship, Point
equals = Equality(FirstNumber=incurve.Relationship, SecondNumber=Slider(2, range=0..10))  # -> Equality, Inequality
cull = CullPattern(List=trim, CullPattern=equals.Equality)
L = ClusterOutput(cull)

# ==== cluster Cluster_2
B = ClusterInput()
C = ClusterInput()
bbox = BoundingBox(Content=C, Plane=PlaneXY(0, 0, 0))  # -> Box, Box_2
join = JoinCurves(Curves=C, Preserve=False)
debrep = DeconstructBrep(Brep=bbox.Box)  # -> Faces, Edges, Vertices
join_2 = JoinCurves(Curves=debrep.Edges, Preserve=False)
area = Area(Geometry=join_2)  # -> Area, Centroid
division = Division(A=area.Area, B=1000)
sqrt = SquareRoot(Value=division)
division_2 = Division(A=sqrt, B=B)
pop2d = Populate2D(Region=join_2, Count=division_2, Seed=1)
incurve = PointInCurve(Point=pop2d, Curve=graft(join))  # -> Relationship, Point
equals = Equality(FirstNumber=incurve.Relationship, SecondNumber=Slider(2, range=0..10))  # -> Equality, Inequality
cull = CullPattern(List=pop2d, CullPattern=equals.Equality)

# ---- group: Remove points that are too close together
cullpt = CullDuplicates(Points=cull, Tolerance=Slider(2000, range=0..10000), CullMode=3)  # -> Points, Indices, Valence

# ----
P = ClusterOutput(cullpt.Points)
