# Grasshopper definition Fields Examples.gh (Grasshopper 0.9.76)
# plug-ins: Groundhog

desired_domain_start = Slider(25, range=0..100)
desired_domain_end = Slider(50, range=0..100)
# Definition prepared for Groundhog v0.5a
# www.groundhog.la
# 
# Prepared by Philip Belesky
# www.philipbelesky.com
# 
# Contact groundhog@philipbelesky.com for support or feedback
number_slider = Slider(50, range=0..100)
# Groundhog Example File
curve = Curve(<curve referenced from the Rhino model>)
curve_2 = Curve([<curve referenced from the Rhino model> x9])
curve_3 = Curve(<curve referenced from the Rhino model>)

# ---- group: Translate geometry to field
field_mapper = FieldMapper(Bounds=curve, Divisions=number_slider, Areas=curve_2, ZRange=0)

# ---- group: Translate field to grid visualisation
field_grid = FieldVisualisationGrid(Field=field_mapper, Bounds=curve_3, DomainStart=desired_domain_start, DomainEnd=desired_domain_end)  # -> Points, Parameters
field_grid_2 = FieldVisualisationGrid(Field=field_mapper, Bounds=curve_3, DomainStart=0, DomainEnd=1)  # -> Points, Parameters
gradient = Gradient(
    LowerLimit=0,
    UpperLimit=1,
    Parameter=field_grid_2.Parameters,
    stops=[0: RGB(0, 128, 0), 0.5: RGB(255, 255, 0), 1: RGB(255, 0, 0)])
circle = CircleCNR(Center=field_grid.Points, Normal=Vector(0, 0, 1), Radius=field_grid.Parameters)
preview = CustomPreview(Geometry=circle, Shader=gradient)
