# Grasshopper definition Groundhog - Barcelona Botanic Gardens.ghx (Grasshopper 1.0.7)
# plug-ins: Groundhog

# ---- group: Project Points to Terrain
# This Grasshopper definition and its corresponding Rhinoceros model were developed by Philip Belesky as part of the Groundhog project.
# 
# The definition and model are provided as speculative reverse-engineerings of how this landscape project could have been (partly) designed using computational methods. More information available at https://groundhog.la/projects/botanical-gardens-of-barcelona/
# 
# This definition depends on components from version v0.11.1b of the Groundhog plugin. It is available for download at http://groundhog.la/plugin/
geometry_pipeline = GeometryPipeline(
    GroupByLayer=False,
    GroupByType=False,
    IncludeHidden=True,
    IncludeLocked=True,
    LayerFilter="*Facet Guides",
    NameFilter="*",
    SublayerFiltering=False,
    TypeFilter=1)
terrain_mesh = Mesh(<mesh referenced from the Rhino model>)
# Groundhog Project File
project_points = ProjectPoints(base_points=geometry_pipeline, terrain_mesh=terrain_mesh)  # -> path_centers_2, guide_lines_2
# Jump to parameters
# for classifying facets
# into aspect/slope ranges
colour_swatch = ColourSwatch(SwatchColor=RGB(255, 0, 255))
custom_preview = CustomPreview(Geometry=project_points.guide_lines_2, Material=colour_swatch)
path_centers = Point(project_points.path_centers_2)

# ---- group: Key Parameters for planted area geometries
plant_boundary_offset = Slider(5000, range=0..5000)
path_offset = Slider(1731, range=0..5000)
plant_offset = Number(plant_boundary_offset)
path_offset_2 = Number(path_offset)

# ---- group: Key parameters for planting distribution and visualisation
growth_projection_years = Slider(10, range=0..100)
area_mm2_per_plant = Slider(4000, range=0..10000)
simulated_time = Number(growth_projection_years)
plant_density = Number(area_mm2_per_plant)

# ---- group: Create and analyse the mesh using the "Facet Vertices" as guides
path_centers_2 = Point(path_centers)
# Note that the delaunay meshing here only very approximately models the path structure. In the as-built design, the paths are heavily modified from the terrain mesh used to determine planting typologies.
delaunay_mesh = DelaunayMesh(Points=path_centers_2, Plane=PlaneXY(0, 0, 0))
mesh_slope = MeshSlope(Mesh=delaunay_mesh)  # -> MeshFaces, FaceCenters, FaceVectors, FaceSlopes, FaceSlopes_2, FaceSlopes_3
mesh_aspect = MeshAspect(Mesh=delaunay_mesh, Aspect=Vector(0, 1, 0))  # -> MeshFaces, FaceCenters, FaceAspects
terrain_mesh_2 = Mesh(delaunay_mesh)
aspects = Number(mesh_aspect.FaceAspects)
slopes = Number(mesh_slope.FaceSlopes)
faces = Mesh(mesh_aspect.MeshFaces)

# ----
face_centers = Point(mesh_slope.FaceCenters)
faces_2 = Mesh(mesh_slope.MeshFaces)
slopes_2 = Integer(slopes)

# ---- group: Create offset edges and convert faces to surfaces
terrain_mesh_3 = Mesh(terrain_mesh_2)
plant_offset_2 = Number(plant_offset)
path_offset_3 = Number(path_offset_2)
face_boundaries = FaceBoundaries(Mesh=terrain_mesh_3)
division = Division(A=path_offset_3, B="-2")
division_2 = Division(A=plant_offset_2, B="-2")
curve = Curve(graft(face_boundaries))
offset_loose = OffsetLoose(Curve=face_boundaries, Distance=division)
curve_2 = Curve(graft(offset_loose))
offset_loose_2 = OffsetLoose(Curve=face_boundaries, Distance=division_2)
boundary_surfaces = BoundarySurfaces(Edges=offset_loose)  # -> flatten(Surfaces)
boundary_surfaces_2 = BoundarySurfaces(Edges=offset_loose_2)  # -> flatten(Surfaces)
boundary_surfaces_3 = BoundarySurfaces(Edges=[curve, curve_2])
planted_surfaces = Surface(boundary_surfaces_2)
facet_surfaces = Surface(boundary_surfaces)
path_surfaces = Geometry(boundary_surfaces_3)

# ---- group: Visualise aspect on mesh faces
faces_3 = Mesh(faces)
aspects_2 = Integer(aspects)
gradient = Gradient(
    LowerLimit=0,
    UpperLimit="360",
    Parameter=aspects_2,
    stops=[0: RGB(90, 70, 162), 0.00483: RGB(0, 162, 255), 0.248: RGB(255, 255, 0), 0.5: RGB(255, 0, 0), 0.745: RGB(255, 255, 0), 1: RGB(0, 162, 255)])
mesh_colours = MeshColours(Mesh=simplify(graft(faces_3)), Colours=simplify(graft(gradient)))
aspect_mesh = Mesh(mesh_colours)

# ---- group: Visualise slope on mesh faces
faces_4 = Mesh(faces_2)
gradient_2 = Gradient(LowerLimit=0, UpperLimit="30", Parameter=slopes_2, stops=[0: RGB(230, 230, 230), 1: RGB(0, 0, 0)])
mesh_colours_2 = MeshColours(Mesh=simplify(graft(faces_4)), Colours=simplify(graft(gradient_2)))
slope_mesh = Mesh(mesh_colours_2)

# ---- group: Visualise path geometries and planted areas
facet_surfaces_2 = Surface(facet_surfaces)
path_surfaces_2 = Geometry(path_surfaces)
custom_preview_2 = CustomPreview(Geometry=facet_surfaces_2, Material=ColourSwatch(SwatchColor=RGB(0, 0, 0)))
custom_preview_3 = CustomPreview(Geometry=path_surfaces_2, Material=ColourSwatch(SwatchColor=RGB(92, 92, 92)))

# ---- group: Label aspects within specified range
text_vector_color = ColourSwatch(SwatchColor=RGB(255, 255, 255))
text_size = Slider(703, range=0..1000)
face_centers_2 = Point(face_centers)
face_slope = Integer(slopes)
face_aspect = Integer(aspects)
concatenate = Concatenate(Fragment_A=face_slope, Fragment_B="° slope, ", A=face_aspect, B="° aspect ")
angles_labels = TextTag3D(Location=face_centers_2, Text=concatenate, Size=text_size, Colour=text_vector_color, Justification=5)

# ---- group: Classify and split up the facets based on their slope and angle into four distinct types based on a given range
slopes_3 = Number(slopes)
lowest_slope = Slider(0, range=0..100)
high_slope = Slider(8, range=0..100)
low_aspect = Slider(90, range=0..360)
high_aspect = Slider(270, range=0..360)
aspects_3 = Number(aspects)
construct_domain = ConstructDomain(DomainStart=lowest_slope, DomainEnd=high_slope)
construct_domain_2 = ConstructDomain(DomainStart=low_aspect, DomainEnd=high_aspect)
includes = Includes(Value=aspects_3, Domain=construct_domain_2)  # -> Includes, Deviation
includes_2 = Includes(Value=slopes_3, Domain=construct_domain)  # -> Includes, Deviation
pie_chart = PieChart(includes.Includes)
pie_chart_2 = PieChart(includes_2.Includes)
planted_surfaces_2 = Surface(planted_surfaces)

# ---- group: Classify and split up the facets based on their slope and angle into four distinct types based on a given range / First False; Second True
gate_and = GateAnd(A=invert(includes_2.Includes), B=includes.Includes)

# ---- group: Classify and split up the facets based on their slope and angle into four distinct types based on a given range / Both False
gate_and_2 = GateAnd(A=invert(includes_2.Includes), B=invert(includes.Includes))

# ---- group: Classify and split up the facets based on their slope and angle into four distinct types based on a given range / First True; Second False
gate_and_3 = GateAnd(A=includes_2.Includes, B=invert(includes.Includes))

# ---- group: Classify and split up the facets based on their slope and angle into four distinct types based on a given range / Both True
gate_and_4 = GateAnd(A=includes_2.Includes, B=includes.Includes)

# ---- group: Classify and split up the facets based on their slope and angle into four distinct types based on a given range / Gradual slope; northern aspect
cull_pattern = CullPattern(List=planted_surfaces_2, CullPattern=gate_and_3)

# ---- group: Classify and split up the facets based on their slope and angle into four distinct types based on a given range / Gradual slope; non-northern aspect
cull_pattern_2 = CullPattern(List=planted_surfaces_2, CullPattern=gate_and_4)

# ---- group: Classify and split up the facets based on their slope and angle into four distinct types based on a given range / Steep slope; northern aspect
cull_pattern_3 = CullPattern(List=planted_surfaces_2, CullPattern=gate_and_2)

# ---- group: Classify and split up the facets based on their slope and angle into four distinct types based on a given range / Steep slope; non-northern aspect
cull_pattern_4 = CullPattern(List=planted_surfaces_2, CullPattern=gate_and)

# ---- group: Classify and split up the facets based on their slope and angle into four distinct types based on a given range (continued)
pie_chart_3 = PieChart(gate_and_3)
# For simplicity, this definition just determines four different 'types' of facet (according to different combinations of aspect and slope) and thus four different types of planting conditions. It's worth noting the actual design has a much more complicated planting palette and matching process.
pie_chart_4 = PieChart(gate_and_2)
pie_chart_5 = PieChart(gate_and)
pie_chart_6 = PieChart(gate_and_4)
surfaces_1 = Surface(cull_pattern_2)
surfaces_2 = Surface(cull_pattern)
surfaces_3 = Surface(cull_pattern_4)
surfaces_4 = Surface(cull_pattern_3)

# ---- group: Assign species of type 2
species_attributes = Panel("""Species Name,Common Name,Indigenous Name,Time to Maturity,Spacing Radius,Initial Crown Radius,Mature Crown Radius,Crown Variance,Initial Trunk Radius,Mature Trunk Radius,Trunk Variance, Initial Height,Mature Height, Height Variance, Initial Root Radius,Mature Root Radius, Root Variance,Display R,Display G,Display B
Fake 1,Fake 1,Fake 1,25,750,500,1600,15,75,200,15,500,12500,15,150,2500,15,210,255,2
Fake 2,Fake 2,Fake 2,50,750,500,1200,25,100,250,25,1000,16000,25,200,1750,25,252,255,2
Fake 3,Fake 3,Fake 3,20,450,300,1400,20,50,175,20,300,3000,20,100,1500,20,255,222,2
Fake 4,Fake 4,Fake 4,12,750,500,1800,30,100,250,20,500,6000,20,200,1850,20,211,217,54""")
ppm = Number(area_mm2_per_plant)
surfaces = Surface(surfaces_2)
year = Number(growth_projection_years)
distribute_species = DistributeSpecies(csv_file=species_attributes, ppmm2=ppm, surfaces=surfaces)  # -> flatten(species_2), flatten(locations_2)
plant_appearance_simulator = PlantAppearanceSimulator(Plants=distribute_species.species_2, Locations=distribute_species.locations_2, Times=year)  # -> Trunk, Root, Crown, Spacing, Color, Label
custom_preview_4 = CustomPreview(Geometry=plant_appearance_simulator.Trunk, Shader=plant_appearance_simulator.Color)
custom_preview_5 = CustomPreview(Geometry=plant_appearance_simulator.Crown, Shader=plant_appearance_simulator.Color)

# ---- group: Assign species of type 1
plant_density_2 = Number(area_mm2_per_plant)
species_attributes_2 = Panel("""Species Name,Common Name,Indigenous Name,Time to Maturity,Spacing Radius,Initial Crown Radius,Mature Crown Radius,Crown Variance,Initial Trunk Radius,Mature Trunk Radius,Trunk Variance, Initial Height,Mature Height, Height Variance, Initial Root Radius,Mature Root Radius, Root Variance,Display R,Display G,Display B
Fake 1,Fake 1,Fake 1,15,250,250,800,15,25,25,15,500,12500,15,150,2500,15,176,184,172
Fake 2,Fake 2,Fake 2,20,300,300,600,25,25,25,25,1000,16000,25,200,1750,25,209,209,163
Fake 3,Fake 3,Fake 3,20,200,200,400,20,25,25,20,300,3000,20,100,1500,20,160,161,167
Fake 4,Fake 4,Fake 4,12,250,250,500,30,25,25,20,500,6000,20,200,1850,20,250,250,250""")
surfaces_5 = Surface(surfaces_1)
year_2 = Number(growth_projection_years)
distribute_species_2 = DistributeSpecies(csv_file=species_attributes_2, ppmm2=plant_density_2, surfaces=surfaces_5)  # -> flatten(species_2), reverse(locations_2)
plant_appearance_simulator_2 = PlantAppearanceSimulator(Plants=distribute_species_2.species_2, Locations=distribute_species_2.locations_2, Times=year_2)  # -> Trunk, Root, Crown, Spacing, Color, Label
custom_preview_6 = CustomPreview(Geometry=plant_appearance_simulator_2.Crown, Shader=plant_appearance_simulator_2.Color)
custom_preview_7 = CustomPreview(Geometry=plant_appearance_simulator_2.Trunk, Shader=plant_appearance_simulator_2.Color)

# ---- group: Assign species of type 3
species_attributes_3 = Panel("""Species Name,Common Name,Indigenous Name,Time to Maturity,Spacing Radius,Initial Crown Radius,Mature Crown Radius,Crown Variance,Initial Trunk Radius,Mature Trunk Radius,Trunk Variance, Initial Height,Mature Height, Height Variance, Initial Root Radius,Mature Root Radius, Root Variance,Display R,Display G,Display B
Fake 1,Fake 1,Fake 1,25,750,500,3000,15,75,200,15,500,12500,15,150,2500,15,11,210,165
Fake 2,Fake 2,Fake 2,50,750,500,1500,25,100,250,25,1000,16000,25,200,1750,25,11,210,203
Fake 3,Fake 3,Fake 3,20,450,300,2000,20,50,175,20,300,3000,20,100,1500,20,11,170,210
Fake 4,Fake 4,Fake 4,12,750,500,3000,30,100,250,20,500,6000,20,200,1850,20,26,163,148""")
ppm_2 = Number(area_mm2_per_plant)
surfaces_6 = Surface(surfaces_3)
year_3 = Number(growth_projection_years)
distribute_species_3 = DistributeSpecies(csv_file=species_attributes_3, ppmm2=ppm_2, surfaces=surfaces_6)  # -> flatten(species_2), flatten(locations_2)
plant_appearance_simulator_3 = PlantAppearanceSimulator(Plants=distribute_species_3.species_2, Locations=distribute_species_3.locations_2, Times=year_3)  # -> Trunk, Root, Crown, Spacing, Color, Label
custom_preview_8 = CustomPreview(Geometry=plant_appearance_simulator_3.Trunk, Shader=plant_appearance_simulator_3.Color)
custom_preview_9 = CustomPreview(Geometry=plant_appearance_simulator_3.Crown, Shader=plant_appearance_simulator_3.Color)

# ---- group: Assign species of type 4
species_attributes_4 = Panel("""Species Name,Common Name,Indigenous Name,Time to Maturity,Spacing Radius,Initial Crown Radius,Mature Crown Radius,Crown Variance,Initial Trunk Radius,Mature Trunk Radius,Trunk Variance, Initial Height,Mature Height, Height Variance, Initial Root Radius,Mature Root Radius, Root Variance,Display R,Display G,Display B
Fake 1,Fake 1,Fake 1,25,750,500,3000,15,75,200,15,500,12500,15,150,2500,15,221,29,78
Fake 2,Fake 2,Fake 2,50,750,500,1500,25,100,250,25,1000,16000,25,200,1750,25,194,33,166
Fake 3,Fake 3,Fake 3,20,450,300,2000,20,50,175,20,300,3000,20,100,1500,20,245,83,83
Fake 4,Fake 4,Fake 4,12,750,500,3000,30,100,250,20,500,6000,20,200,1850,20,136,25,69""")
ppm_3 = Number(area_mm2_per_plant)
surfaces_7 = Surface(surfaces_4)
year_4 = Number(growth_projection_years)
distribute_species_4 = DistributeSpecies(csv_file=species_attributes_4, ppmm2=ppm_3, surfaces=surfaces_7)  # -> flatten(species_2), flatten(locations_2)
plant_appearance_simulator_4 = PlantAppearanceSimulator(Plants=distribute_species_4.species_2, Locations=distribute_species_4.locations_2, Times=year_4)  # -> Trunk, Root, Crown, Spacing, Color, Label
custom_preview_10 = CustomPreview(Geometry=plant_appearance_simulator_4.Trunk, Shader=plant_appearance_simulator_4.Color)
custom_preview_11 = CustomPreview(Geometry=plant_appearance_simulator_4.Crown, Shader=plant_appearance_simulator_4.Color)

# ---- group: Visualise slope/aspects off to the side
aspect_mesh_2 = Mesh(aspect_mesh)
offset_analysis_m = Slider(453, range=0..1000)
# I assume the actual planting plans for each of the facets was not automatically generated (i.e. only a palette was algorithmically selected) but for visualisation purposes lets randomly allocate different sets of (fake) species to illustrate the different face-types.
slope_mesh_2 = Mesh(slope_mesh)

# ----
unit_y = UnitY(Factor=offset_analysis_m)

# ---- group: Visualise slope/aspects off to the side (continued)
move = Move(Geometry=aspect_mesh_2, Motion=expr("x*1000", unit_y))  # -> Geometry, Transform
move_2 = Move(Geometry=slope_mesh_2, Motion=expr("x*2000", unit_y))  # -> Geometry, Transform

# ==== cluster DistributeSpecies
surfaces = ClusterInput()
ppmm2 = ClusterInput()
surfaces_2 = Surface(surfaces)
ppmm2_2 = Number(ppmm2)
area = Area(Geometry=surfaces_2)  # -> Area, Centroid
square = Square(Value=ppmm2_2)
mesh = Mesh(surfaces_2)
division = Division(A=area.Area, B=square)
csv_file = ClusterInput()
populate_geometry = PopulateGeometry(Geometry=mesh, Count=division, Seed=1)
list_length = ListLength(List=csv_file)
list_length_2 = ListLength(List=populate_geometry)
species_attribute_importer = SpeciesAttributeImporter(CSVFile=csv_file)
random = Random(Range=list_length, Number=list_length_2, Seed=2)
locations = Point(populate_geometry)
list_item = ListItem(List=species_attribute_importer, Index=random, Wrap=True)
species = Data(list_item)
locations_2 = ClusterOutput(locations)
species_2 = ClusterOutput(species)

# ==== cluster ProjectPoints
terrain_mesh = ClusterInput()
base_points = ClusterInput()
unit_z = UnitZ(Factor=-1)
unit_z_2 = UnitZ(Factor=1)
terrain_mesh_2 = Mesh(terrain_mesh)
base_points_2 = Point(base_points)
project_point = ProjectPoint(Point=base_points_2, Direction=unit_z_2, Geometry=terrain_mesh_2)  # -> Point, Index
project_point_2 = ProjectPoint(Point=base_points_2, Direction=unit_z, Geometry=terrain_mesh_2)  # -> Point, Index
null_item = NullItem(Item=project_point.Point)  # -> NullFlags, InvalidFlags, Description
null_item_2 = NullItem(Item=project_point_2.Point)  # -> NullFlags, InvalidFlags, Description
cull_pattern = CullPattern(List=base_points_2, CullPattern=invert(null_item_2.NullFlags))
cull_pattern_2 = CullPattern(List=base_points_2, CullPattern=invert(null_item.NullFlags))
cull_pattern_3 = CullPattern(List=project_point.Point, CullPattern=invert(null_item.NullFlags))
cull_pattern_4 = CullPattern(List=project_point_2.Point, CullPattern=invert(null_item_2.NullFlags))
line = Line(StartPoint=cull_pattern, EndPoint=cull_pattern_4)
line_2 = Line(StartPoint=cull_pattern_2, EndPoint=cull_pattern_3)
path_centers = Point([cull_pattern_3, cull_pattern_4])
guide_lines = Line([line, line_2])
path_centers_2 = ClusterOutput(path_centers)
guide_lines_2 = ClusterOutput(guide_lines)
