# Grasshopper definition Groundhog - Busan Cinema Complex.ghx (Grasshopper 0.9.76)
# plug-ins: Groundhog

# ---- group: Create landform surface from the elevated contour curves in Rhinoceros
geometry_pipeline = GeometryPipeline(
    GroupByLayer=False,
    GroupByType=False,
    IncludeHidden=True,
    IncludeLocked=True,
    LayerFilter="Contours",
    NameFilter="*",
    TypeFilter=4)
patch = Patch(Curves=geometry_pipeline, Spans=20, Flexibility=1, Trim=False)
landform = Surface(patch)

# ---- group: Set paved area and paving grid
# Groundhog Project File
# This Grasshopper definition and its corresponding Rhinoceros model were developed by Albert Rex and Philip Belesky as part of the Groundhog project.
# 
# The definition and model are provided as speculative reverse-engineerings of how this landscape project could have been (partly) designed using computational methods. More information available at https://www.groundhog.la/projects/busan-cinema-complex/
# 
# This definition depends on components from version v0.9.1b of the Groundhog plugin. It is available for download at http://groundhog.la/plugin/
# 
# This definition is licensed under the terms of the GPL v3 https://opensource.org/licenses/GPL-3.0
paver_y_grid_spacing = Slider(2100, range=0..10000)
paver_x_grid_spacing = Slider(5550, range=0..10000)
paved_areas = Curve([<curve referenced from the Rhino model> x2])

# ---- group: Calculate flow paths (disabled for speed)
number_slider = Slider(6000, range=2000..8000)  # disabled
number_slider_2 = Slider(25, range=0..50)  # disabled
number_slider_3 = Slider(25, range=0..50)  # disabled
surface = Surface(landform)  # disabled
divide_surface = DivideSurface(Surface=surface, UCount=number_slider_3, VCount=number_slider_2)  # -> flatten(Points), Normals, Parameters; disabled
flow_projection_surface = FlowProjectionSurface(Surface=surface, Points=divide_surface.Points, Fidelity=number_slider, Steps=0, Thread=False)  # -> FlowPoints, FlowPaths; disabled
colour_swatch = ColourSwatch(SwatchColor=RGB(65, 0, 245))  # disabled
custom_preview = CustomPreview(Geometry=flow_projection_surface.FlowPaths, Shader=colour_swatch)  # disabled

# ---- group: Get maximum x/y dimensions of each patch; use those to determine the paving grid size
bounding_box = BoundingBox(Content=landform, Plane=PlaneXY(0, 0, 0))  # -> Box, Box_2
deconstruct_box = DeconstructBox(Box=bounding_box.Box)  # -> Plane, X, Y, Z
deconstruct_domain = DeconstructDomain(Domain=deconstruct_box.Y)  # -> Start, End
deconstruct_domain_2 = DeconstructDomain(Domain=deconstruct_box.X)  # -> Start, End
z_domain = Domain(deconstruct_box.Z)

# ----
subtraction = Subtraction(A=deconstruct_domain.End, B=deconstruct_domain.Start)
subtraction_2 = Subtraction(A=deconstruct_domain_2.End, B=deconstruct_domain_2.Start)

# ---- group: Get maximum x/y dimensions of each patch; use those to determine the paving grid size (continued)
maximum_x = Number(subtraction_2)
maximum_y = Number(subtraction)

# ---- group: Divide up each surface using the predefined grid distance (won't be perfectly square; but good enough)
division = Division(A=maximum_x, B=paver_y_grid_spacing)
division_2 = Division(A=maximum_y, B=paver_x_grid_spacing)
divide_surface_2 = DivideSurface(Surface=landform, UCount=division, VCount=division_2)  # -> flatten(Points), Normals, Parameters
null_item = NullItem(Item=divide_surface_2.Points)  # -> NullFlags, InvalidFlags, Description
cull_pattern = CullPattern(List=divide_surface_2.Points, CullPattern=invert(null_item.InvalidFlags))
paving_origins = Point(cull_pattern)

# ----
z_domain_2 = Domain(z_domain)
z_domain_3 = Domain(z_domain)
z_domain_4 = Domain(z_domain_2)
z_domain_5 = Domain(z_domain_2)

# ---- group: Remove out of bounds points
paving_origins_2 = Point(paving_origins)
curve = Curve(paved_areas)
point_in_curve = PointInCurve(Point=paving_origins_2, Curve=graft(curve))  # -> Relationship, Point

# ----
flip_matrix = FlipMatrix(Data=point_in_curve.Relationship)
mass_addition = MassAddition(Input=flip_matrix)  # -> flatten(Result), PartialResults
# Using projection and then checking for null results would also work for this task; however it is slower when there are large number of points to check.
equality = Equality(FirstNumber=mass_addition.Result, SecondNumber=2)  # -> Equality, Inequality

# ---- group: Remove out of bounds points (continued)
cull_pattern_2 = CullPattern(List=paving_origins_2, CullPattern=invert(equality.Inequality))
paving_origins_3 = Point(cull_pattern_2)

# ---- group: Create base tile object
initial_width = Slider(283, range=0..4000)
sides = Slider(4, range=0..10)
paving_origins_4 = Point(paving_origins_3)
initial_rotation = Slider(0.785, range=0..1)
rotate_plane = RotatePlane(Plane=paving_origins_4, Angle=initial_rotation)
polygon = Polygon(Plane=rotate_plane, Radius=initial_width, Segments=sides, FilletRadius=0)  # -> Polygon, Length

# ---- group: Manipulate bottom tile rotation by Z
paving_origins_5 = Point(paving_origins_3)
z_domain_6 = Domain(z_domain_2)
deconstruct = Deconstruct(Point=paving_origins_5)  # -> XComponent, YComponent, ZComponent
construct_domain = ConstructDomain(DomainStart=Slider(2.791, range=0..3.14), DomainEnd=Slider(0.557, range=0..3.5))
construct_domain_2 = ConstructDomain(DomainStart=Slider(2, range=0..10), DomainEnd=Slider(0, range=0..10))
construct_domain_3 = ConstructDomain(DomainStart=Slider(11, range=0..20), DomainEnd=Slider(4, range=0..10))

# ---- group: Manipulate bottom tile rotation by Z / Rotation Target
remap_numbers = RemapNumbers(Value=deconstruct.ZComponent, Source=z_domain_6, Target=construct_domain)  # -> Mapped, Clipped

# ---- group: Manipulate bottom tile rotation by Z / Y Size Target
remap_numbers_2 = RemapNumbers(Value=deconstruct.ZComponent, Source=z_domain_5, Target=construct_domain_2)  # -> Mapped, Clipped

# ---- group: Manipulate bottom tile rotation by Z / X Size Target
remap_numbers_3 = RemapNumbers(Value=deconstruct.ZComponent, Source=z_domain_4, Target=construct_domain_3)  # -> Mapped, Clipped

# ---- group: Manipulate bottom tile rotation by Z (continued)
scale_nu = ScaleNU(Geometry=polygon.Polygon, Plane=paving_origins_5, ScaleX=remap_numbers_3.Mapped, ScaleY=remap_numbers_2.Mapped, ScaleZ=1)  # -> Geometry, Transform
rotate = Rotate(Geometry=scale_nu.Geometry, Angle=remap_numbers.Mapped, Plane=rotate_plane)  # -> Geometry, Transform
rotated_tiles_b = Curve(rotate.Geometry)

# ---- group: Manipulate top tile rotation/scale by Z
z_domain_7 = Domain(z_domain_3)
z_domain_8 = Domain(z_domain_3)
z_domain_9 = Domain(z_domain_3)
paving_origins_6 = Point(paving_origins_3)
deconstruct_2 = Deconstruct(Point=paving_origins_6)  # -> XComponent, YComponent, ZComponent
construct_domain_4 = ConstructDomain(DomainStart=Slider(0.49, range=0..3.14), DomainEnd=Slider(1.606, range=0..3.14))
construct_domain_5 = ConstructDomain(DomainStart=Slider(3, range=0..10), DomainEnd=Slider(1, range=0..10))
construct_domain_6 = ConstructDomain(DomainStart=Slider(14, range=0..20), DomainEnd=Slider(4, range=0..10))

# ---- group: Manipulate top tile rotation/scale by Z / Rotation Target
remap_numbers_4 = RemapNumbers(Value=deconstruct_2.ZComponent, Source=z_domain_7, Target=construct_domain_4)  # -> Mapped, Clipped

# ---- group: Manipulate top tile rotation/scale by Z / X Size Target
remap_numbers_5 = RemapNumbers(Value=deconstruct_2.ZComponent, Source=z_domain_8, Target=construct_domain_6)  # -> Mapped, Clipped

# ---- group: Manipulate top tile rotation/scale by Z / Y Size Target
remap_numbers_6 = RemapNumbers(Value=deconstruct_2.ZComponent, Source=z_domain_9, Target=construct_domain_5)  # -> Mapped, Clipped

# ---- group: Manipulate top tile rotation/scale by Z (continued)
scale_nu_2 = ScaleNU(Geometry=polygon.Polygon, Plane=paving_origins_6, ScaleX=remap_numbers_5.Mapped, ScaleY=remap_numbers_6.Mapped, ScaleZ=1)  # -> Geometry, Transform
rotate_2 = Rotate(Geometry=scale_nu_2.Geometry, Angle=remap_numbers_4.Mapped, Plane=rotate_plane)  # -> Geometry, Transform
rotated_tiles_a = Curve(rotate_2.Geometry)

# ---- group: Quick and Simple Preview
rotated_tiles_a_2 = Curve(rotated_tiles_a)
rotated_tiles_b_2 = Curve(rotated_tiles_b)
custom_preview_2 = CustomPreview(Geometry=[rotated_tiles_a_2, rotated_tiles_b_2], Material=ColourSwatch(SwatchColor=RGB(138, 138, 138)))

# ---- group: Slow and Fancy Preview (disabled for speed) / Intersect the two rotations to make a single outline curve
rotated_tiles_b_3 = Curve(rotated_tiles_b)  # disabled
rotated_tiles_a_3 = Curve(rotated_tiles_a)  # disabled
trim_with_region = TrimWithRegion(Curve=rotated_tiles_a_3, Region=rotated_tiles_b_3)  # -> Inside, Outside; disabled
trim_with_region_2 = TrimWithRegion(Curve=rotated_tiles_b_3, Region=rotated_tiles_a_3)  # -> Inside, Outside; disabled
join_curves = JoinCurves(Curves=[trim_with_region.Outside, trim_with_region_2.Outside], Preserve=False)  # disabled

# ---- group: Slow and Fancy Preview (disabled for speed)
colour_swatch_2 = ColourSwatch(SwatchColor=RGB(255, 255, 255))  # disabled
boundary_surfaces = BoundarySurfaces(Edges=join_curves)  # disabled
custom_preview_3 = CustomPreview(Geometry=boundary_surfaces, Material=colour_swatch_2)  # disabled
