# Grasshopper definition Groundhog - Epaphic Effects.ghx (Grasshopper 1.0.7)

geometry_pipeline = GeometryPipeline(
    GroupByLayer=False,
    GroupByType=False,
    IncludeHidden=True,
    IncludeLocked=True,
    LayerFilter="*Contours",
    NameFilter="*",
    SublayerFiltering=True,
    TypeFilter=4)
maximum_cell_offset = Slider(7, range=0..10)
minimum_cell_offset = Slider(3, range=0..10)
# Groundhog Project File
# This Grasshopper definition and its corresponding Rhinoceros model were developed by Albert Rex and Philip Belesky as part of the Groundhog project.
# 
# The definition and model are provided as speculative reverse-engineerings of how this landscape project could have been (partly) designed using computational methods. More information available at https://www.groundhog.la/projects/busan-cinema-complex/
# 
# This definition depends on components from version v0.11.0b of the Groundhog plugin. It is available for download at http://groundhog.la/plugin/
cell_count_x = Slider(14, range=0..55)
cell_count_y = Slider(15, range=0..100)
patch = Patch(Curves=geometry_pipeline, Spans=20, Flexibility=1, Trim=True)
guide_curves_for_skin = Curve([<curve referenced from the Rhino model> x4])
maximum_cell_offset_2 = Number(maximum_cell_offset)
minimum_cell_offset_2 = Number(minimum_cell_offset)
landform_surface = Surface(patch)
y_cells = Number(cell_count_y)
x_cells = Number(cell_count_x)

# ---- group: Orders input curves and lofts surface
guide_curves_for_skin_2 = Curve(guide_curves_for_skin)
landform_surface_2 = Surface(landform_surface)
point_on_curve = PointOnCurve(guide_curves_for_skin_2, parameter=0.5)
deconstruct = Deconstruct(Point=point_on_curve)  # -> XComponent, YComponent, ZComponent
sort_list = SortList(Keys=deconstruct.YComponent, ValuesValuesA=guide_curves_for_skin_2)  # -> Keys, ValuesValuesA
project = Project(Curve=sort_list.ValuesValuesA, Brep=landform_surface_2, Direction=Vector(0, 0, 1))
trim_tree = TrimTree(Tree=project, Depth=1)
loft = Loft(Curves=trim_tree, Options={Adjust=False, Closed=False, LoftEnds=0, LoftSimp=0, LoftType=0, Rebuild=10, Refit=0.01})
lofted_base_surface = Surface(loft)

# ---- group: This cluster stretches a diamond grid over the top of the lofted surface
x_cells_2 = Number(x_cells)
y_cells_2 = Number(y_cells)
lofted_base_surface_2 = Surface(lofted_base_surface)
cluster = Cluster(v_count=x_cells_2, surface=lofted_base_surface_2, u_count=y_cells_2)
cell_curves = Curve(cluster)

# ---- group: Diamonds are broken down into corner points for construction of innner wall
control_points = ControlPoints(Curve=cluster)  # -> Points, Weights, Knots

# ---- group: Finds lowest and highest corner of each cell
# This is where you could substitute in another factor to control the inner cell offsets. For example you could sample the area or aspect of each cell to inform how much it dilates.
cell_corners = Point(control_points.Points)
deconstruct_2 = Deconstruct(Point=cell_corners)  # -> XComponent, YComponent, ZComponent
sort_list_2 = SortList(Keys=deconstruct_2.ZComponent, ValuesValuesA=cell_corners)  # -> Keys, ValuesValuesA
list_item = ListItem(List=sort_list_2.ValuesValuesA, Index="0", Wrap=True)
list_item_2 = ListItem(List=sort_list_2.ValuesValuesA, Index="4", Wrap=True)
deconstruct_3 = Deconstruct(Point=list_item)  # -> XComponent, YComponent, ZComponent
deconstruct_4 = Deconstruct(Point=list_item_2)  # -> XComponent, YComponent, ZComponent
subtraction = Subtraction(A=deconstruct_4.ZComponent, B=deconstruct_3.ZComponent)  # -> flatten(Result)
cell_z_height_differences = Number(subtraction)

# ---- group: Seperates out the 4 corner points of each cell
cell_corners_2 = Point(control_points.Points)
panel = Panel("""1
3""")
list_item_3 = ListItem(List=cell_corners_2, Index=panel, Wrap=True)
list_item_4 = ListItem(List=cell_corners_2, Index="1", Wrap=True)
list_item_5 = ListItem(List=cell_corners_2, Index="3", Wrap=True)
list_item_6 = ListItem(List=cell_corners_2, Index="2", Wrap=True)
list_item_7 = ListItem(List=cell_corners_2, Index="0", Wrap=True)
right_points = Point(list_item_4)
top_points = Point(list_item_7)
left_points = Point(list_item_6)
point = Point(list_item_5)
point_2 = Point(list_item_3)

# ---- group: Outer Cell Walls
curve = Curve(cell_curves)
custom_preview = CustomPreview(Geometry=curve, Shader=ColourSwatch(SwatchColor=RGB(255, 255, 255)))

# ---- group: Uses the vertical distance betweent these two points to calculate cell dilation
minimum_cell_offset_3 = Number(minimum_cell_offset_2)
maximum_cell_offset_3 = Number(maximum_cell_offset_2)
cell_z_height_differences_2 = Number(cell_z_height_differences)
construct_domain = ConstructDomain(DomainStart=minimum_cell_offset_3, DomainEnd=maximum_cell_offset_3)

# ----
bounds = Bounds(Numbers=cell_z_height_differences_2)

# ---- group: Uses the vertical distance betweent these two points to calculate cell dilation (continued)
remap_numbers = RemapNumbers(Value=cell_z_height_differences_2, Source=bounds, Target=construct_domain)  # -> Mapped, Clipped
offsets = Number(remap_numbers.Mapped)

# ---- group: Offsets walls of cells inward based on slope
point_3 = Point(left_points)
cell_curves_2 = Curve(cell_curves)
cell_offsets = Number(offsets)
point_4 = Point(top_points)
vector_2pt = Vector2Pt(PointA=point_4, PointB=point_3, Unitize=False)  # -> Vector, Length
vector_2pt_2 = Vector2Pt(PointA=point_3, PointB=point_4, Unitize=False)  # -> Vector, Length
division = Division(A=flatten(vector_2pt_2.Vector), B=cell_offsets)
division_2 = Division(A=flatten(vector_2pt.Vector), B=cell_offsets)
move = Move(Geometry=flatten(point_3), Motion=division)  # -> Geometry, Transform
move_2 = Move(Geometry=flatten(point_4), Motion=division_2)  # -> Geometry, Transform
point_5 = Point([move_2.Geometry, move.Geometry])
point_in_curves = PointInCurves(Point=point_5, Curves=graft(cell_curves_2))  # -> Relationship, Index, Point
equality = Equality(FirstNumber=Slider(2, range=0..10), SecondNumber=point_in_curves.Relationship)  # -> Equality, Inequality
dispatch = Dispatch(List=point_5, DispatchPattern=equality.Equality)  # -> ListA, ListB
offset_edge_points = Point(dispatch.ListA)

# ----
offset_edge_points_2 = Point(offset_edge_points)
point_6 = Point(right_points)
point_7 = Point(point)
point_8 = Point(point_2)
deconstruct_5 = Deconstruct(Point=offset_edge_points_2)  # -> XComponent, YComponent, ZComponent
line = Line(StartPoint=point_6, EndPoint=point_7)
sort_list_3 = SortList(Keys=deconstruct_5.XComponent, ValuesValuesA=offset_edge_points_2)  # -> Keys, ValuesValuesA
list_item_8 = ListItem(List=sort_list_3.ValuesValuesA, Index="1", Wrap=True)
list_item_9 = ListItem(List=sort_list_3.ValuesValuesA, Index="0", Wrap=True)
insert_items = InsertItems(List=point_8, Item=list_item_9, Indices=2, Wrap=True)
insert_items_2 = InsertItems(List=point_8, Item=list_item_8, Indices=2, Wrap=True)
sort_along_curve = SortAlongCurve(Points=insert_items, Curve=line)  # -> Points, Indices
sort_along_curve_2 = SortAlongCurve(Points=insert_items_2, Curve=line)  # -> Points, Indices
polyline = PolyLine(Vertices=sort_along_curve.Points, Closed=False)
polyline_2 = PolyLine(Vertices=sort_along_curve_2.Points, Closed=False)
cell_curves_3 = Curve(polyline)
cell_curves_4 = Curve(polyline_2)

# ---- group: Inner Cell Walls
curve_2 = Curve([cell_curves_3, cell_curves_4])
custom_preview_2 = CustomPreview(Geometry=curve_2, Shader=ColourSwatch(SwatchColor=RGB(0, 255, 25)))

# ==== cluster Cluster
u_count = ClusterInput()
v_count = ClusterInput()
surface = ClusterInput()

# ---- group: Ensure number of diamond West-points doesn't exceed surface columns
u_count_2 = Number(u_count)
division = Division(A=u_count_2, B=2)
round = Round(Number=division)  # -> Nearest, Floor, Ceiling
subtraction = Subtraction(A=round.Floor, B=1)

# ----
u_count_3 = Number(u_count_2)

# ---- group: Ensure number of diamond North-points doesn't exceed surface rows
v_count_2 = Number(v_count)
division_2 = Division(A=v_count_2, B=2)
round_2 = Round(Number=division_2)  # -> Nearest, Floor, Ceiling
subtraction_2 = Subtraction(A=round_2.Floor, B=1)

# ----
divide_surface = DivideSurface(Surface=surface, UCount=u_count_2, VCount=v_count_2)  # -> Points, Normals, Parameters
dispatch = Dispatch(List=divide_surface.Points, DispatchPattern=[True, False])  # -> ListA, ListB
flip_matrix = FlipMatrix(Data=dispatch.ListB)
dispatch_2 = Dispatch(List=flip_matrix, DispatchPattern=[True, False])  # -> ListA, ListB

# ---- group: Ensure number of diamond West-points doesn't exceed surface columns (continued)
sub_list = SubList(List=dispatch_2.ListA, Domain=subtraction, Wrap=False)  # -> List, Index

# ---- group: Offset that list to get South-points for diamonds
number_slider = Slider(1, range=0..10)
addition = Addition(A=subtraction_2, B=number_slider)
construct_domain = ConstructDomain(DomainStart=number_slider, DomainEnd=addition)
sub_list_2 = SubList(List=dispatch.ListA, Domain=construct_domain, Wrap=False)  # -> List, Index

# ---- group: Offset that list to get East points for diamonds
number_slider_2 = Slider(1, range=0..10)
addition_2 = Addition(A=subtraction_2, B=number_slider_2)
construct_domain_2 = ConstructDomain(DomainStart=number_slider_2, DomainEnd=addition_2)
sub_list_3 = SubList(List=dispatch_2.ListA, Domain=construct_domain_2, Wrap=False)  # -> List, Index

# ---- group: Ensure number of diamond North-points doesn't exceed surface rows (continued)
sub_list_4 = SubList(List=dispatch.ListA, Domain=subtraction_2, Wrap=False)  # -> List, Index

# ---- group: Pattern Phase 1
flip_matrix_2 = FlipMatrix(Data=sub_list_4.List)
flip_matrix_3 = FlipMatrix(Data=sub_list_2.List)
point = Point(graft(sub_list_3.List))
dispatch_3 = Dispatch(List=flip_matrix_3, DispatchPattern=[True, False])  # -> ListA, ListB
dispatch_4 = Dispatch(List=flip_matrix_2, DispatchPattern=[True, False])  # -> ListA, ListB
point_2 = Point(graft(dispatch_3.ListB))
point_3 = Point(graft(dispatch_4.ListB))
point_4 = Point(graft(sub_list.List))
create_pattern_a = Merge(Data1=point_3, Data2=point_4, Data3=point_2, Data4=point, Data5=point_3)
polyline = PolyLine(Vertices=create_pattern_a, Closed=False)  # -> flatten(Polyline)

# ---- group: Pattern Phase 2
trim_tree = TrimTree(Tree=point, Depth=1)
addition_3 = Addition(A=u_count_3, B=1)
trim_tree_2 = TrimTree(Tree=simplify(point_2), Depth=1)
list_length = ListLength(List=trim_tree)
modulus = Modulus(A=addition_3, B=Slider(2, range=0..10))
subtraction_3 = Subtraction(A=list_length, B=Slider(1, range=0..1))
subtraction_4 = Subtraction(A=subtraction_3, B=modulus)
tree_statistics = TreeStatistics(Tree=trim_tree_2)  # -> Paths, Length, Count
sub_list_5 = SubList(List=trim_tree, Domain=subtraction_4, Wrap=False)  # -> List, Index
subtraction_5 = Subtraction(A=tree_statistics.Count, B=1)
point_5 = Point(sub_list_5.List)
construct_path = ConstructPath(Indices=subtraction_5)
split_tree = SplitTree(Data=simplify(trim_tree_2), Masks=flatten(construct_path))  # -> Positive, Negative
tree_statistics_2 = TreeStatistics(Tree=point_5)  # -> Paths, Length, Count
subtraction_6 = Subtraction(A=tree_statistics_2.Count, B=1)
cull_index = CullIndex(List=split_tree.Negative, Indices=0, Wrap=True)
cull_index_2 = CullIndex(List=split_tree.Negative, Indices=-1, Wrap=True)
construct_path_2 = ConstructPath(Indices=subtraction_6)
east = Point(flatten(cull_index))
west = Point(flatten(cull_index_2))
split_tree_2 = SplitTree(Data=simplify(point_5), Masks=flatten("{0}"))  # -> Positive, Negative
split_tree_3 = SplitTree(Data=simplify(point_5), Masks=flatten(construct_path_2))  # -> Positive, Negative
south = Point(flatten(split_tree_2.Negative))
north = Point(flatten(split_tree_3.Negative))
east_2 = CustomPreview(Geometry=east, Material=ColourSwatch(SwatchColor=RGB(0, 0, 0)))
west_2 = CustomPreview(Geometry=west, Material=ColourSwatch(SwatchColor=RGB(244, 0, 255)))
norths = CustomPreview(Geometry=south, Material=ColourSwatch(SwatchColor=RGB(255, 255, 255)))
south_2 = CustomPreview(Geometry=north, Material=ColourSwatch(SwatchColor=RGB(120, 244, 255)))
merge = Merge(Data1=graft(south), Data2=graft(east), Data3=graft(north), Data4=graft(west), Data5=graft(south))
polyline_2 = PolyLine(Vertices=merge, Closed=False)  # -> flatten(Polyline)

# ----
curve = Curve([polyline, polyline_2])
curve_2 = ClusterOutput(curve)
