# Grasshopper definition Groundhog - Keio University Roof Garden.ghx (Grasshopper 0.9.76)
# plug-ins: Groundhog

# ---- group: Planting design parameters
random_seed_for_trees_vs_grasses = Slider(6, range=0..10)
time_years_post_planting = Slider(3, range=0..10)
of_trees_vs_grasses = Slider(0.1, range=0..1)
simulated_time = Integer(time_years_post_planting)
random_seed = Number(random_seed_for_trees_vs_grasses)
of_trees = Number(of_trees_vs_grasses)

# ---- group: The different sizes for each of the 6 tile types
slab_5_circumference = Slider(0, range=0..100)
slab_1_circumference = Slider(375, range=0..1000)
slab_2_circumference = Slider(300, range=0..1000)
slab_4_circumference = Slider(150, range=0..1000)
slab_3_circumference = Slider(200, range=0..1000)

# ---- group: Use bounds and paver size to create grid dimensions
paver_s_y_dimension = Slider(500, range=250..1000)
paver_s_x_dimension = Slider(500, range=250..1000)

# ---- group: Roof Perimeter
# Groundhog Project File
# This Grasshopper definition and its corresponding Rhinoceros model were developed by Philip Belesky as part of the Groundhog project.
# 
# The definition and model are provided as speculative reverse-engineerings of how this landscape project could have been (partly) designed using computational methods. More information available at https://www.groundhog.la/projects/keio-university-roof-garden/
# 
# This definition depends on components from version v0.9.1b of the Groundhog plugin. It is available for download at http://groundhog.la/plugin/
# 
# This definition is licensed under the terms of the GPL v3 https://opensource.org/licenses/GPL-3.0
# 
# After creating this I realised the generative landscapes page had also done a tutorial on this project, checkout this link for their approach: https://generativelandscapes.wordpress.com/2014/11/17/keio-university-roof-garden-michel-desvigne-case-study-02/
bounds_for_geometry = Curve(<curve referenced from the Rhino model>)

# ----
create_grid = CreateGrid(C=bounds_for_geometry, sx=paver_s_y_dimension, sy=paver_s_x_dimension)  # -> C_2, x_2, y_2

# ---- group: Get Cell centers (faster than by using area)
cells = Curve(create_grid.C_2)
point_on_curve = PointOnCurve(cells, parameter=0.5)
point_on_curve_2 = PointOnCurve(cells, parameter=0)
vector_2pt = Vector2Pt(PointA=point_on_curve_2, PointB=point_on_curve, Unitize=False)  # -> Vector, Length
multiplication = Multiplication(A=vector_2pt.Vector, B=0.5)
move = Move(Geometry=point_on_curve_2, Motion=multiplication)  # -> Geometry, Transform

# ---- group: Create random slabs
# Note: you may need to re-reference this image to the "Keio Billboard" you downloaded along with this definition. Note also that this image was made as a very loose approximation of what is constructed. There is a source image for the sampling provided in Intermediary Natures but it does not seem to correlate to the built design directly.
slab_1circumference = Integer(slab_1_circumference)
slab_2_circumference_2 = Integer(slab_2_circumference)
slab_5_circumference_2 = Integer(slab_5_circumference)
slab_4_circumference_2 = Integer(slab_4_circumference)
slab_3_circumference_2 = Integer(slab_3_circumference)
x_pavers_count = Integer(create_grid.x_2)
y_pavers_count = Integer(create_grid.y_2)
series = Series(Start=0, Step=1, Count=x_pavers_count)
series_2 = Series(Start=0, Step=1, Count=y_pavers_count)
remap_numbers = RemapNumbers(Value=series_2, Source=y_pavers_count, Target=Domain(0, 1))  # -> Mapped, Clipped
remap_numbers_2 = RemapNumbers(Value=series, Source=x_pavers_count, Target=Domain(0, 1))  # -> Mapped, Clipped
list_length = ListLength(List=[slab_5_circumference_2, slab_4_circumference_2, slab_3_circumference_2, slab_2_circumference_2, slab_1circumference])
construct_point = ConstructPoint(XCoordinate=graft(remap_numbers_2.Mapped), YCoordinate=remap_numbers.Mapped, ZCoordinate=0)  # -> flatten(Point)
image_sampler = ImageSampler(
    construct_point,
    FilePath="C:\Users\philip\Code\groundhog\projects\keio-university-roof-garden\Keio Billboard.png",
    Filter="Value",
    Interpolate=True,
    Umax=1,
    Umin=0,
    Vmax=1,
    Vmin=0,
    Wrap=1)
subtraction = Subtraction(A=list_length, B=1)
remap_numbers_3 = RemapNumbers(Value=image_sampler, Source=Domain(0, 1), Target=subtraction)  # -> Mapped, Clipped
round = Round(Number=remap_numbers_3.Mapped)  # -> Nearest, Floor, Ceiling
pick_n_choose = PickNChoose(
    Pattern=graft(round.Nearest),
    Stream0=slab_5_circumference_2,
    Stream1=slab_4_circumference_2,
    Stream2=slab_3_circumference_2,
    Stream3=slab_2_circumference_2,
    Stream4=slab_1circumference)  # -> flatten(Result)
division = Division(A=pick_n_choose, B=2)
tile_radii = Integer(division)

# ---- group: Cull cells outside bounds
cells_2 = Curve(create_grid.C_2)
bounds = Curve(bounds_for_geometry)
centers = Point(move.Geometry)
point_in_curve = PointInCurve(Point=centers, Curve=bounds)  # -> Relationship, Point
equality = Equality(FirstNumber=point_in_curve.Relationship, SecondNumber=2)  # -> Equality, Inequality
cull_pattern = CullPattern(List=tile_radii, CullPattern=equality.Equality)
cull_pattern_2 = CullPattern(List=cells_2, CullPattern=equality.Equality)
cull_pattern_3 = CullPattern(List=centers, CullPattern=equality.Equality)
tile_radii_2 = Integer(cull_pattern)
centers_2 = Point(cull_pattern_3)
cells_3 = Rectangle(cull_pattern_2)

# ---- group: Create slab width
equality_2 = Equality(FirstNumber=tile_radii_2, SecondNumber=0)  # -> Equality, Inequality
cells_4 = Curve(graft(cells_3))
centers_3 = Point(centers_2)
tile_radii_3 = Integer(cull_pattern)
larger_than = LargerThan(FirstNumber=tile_radii_3, SecondNumber=0)  # -> LargerThan, OrEqualTo
cull_pattern_4 = CullPattern(List=flatten(cells_4), CullPattern=invert(equality_2.Inequality))
cull_pattern_5 = CullPattern(List=flatten(cells_4), CullPattern=equality_2.Inequality)
cull_pattern_6 = CullPattern(List=centers_3, CullPattern=equality_2.Inequality)
cull_pattern_7 = CullPattern(List=tile_radii_2, CullPattern=equality_2.Inequality)
circle_cnr = CircleCNR(Center=cull_pattern_6, Normal=Vector(0, 0, 1), Radius=cull_pattern_7)
cull_pattern_8 = CullPattern(List=centers_3, CullPattern=larger_than.LargerThan)
non_punctured_slabs = Curve(cull_pattern_4)
centers_with_gaps = Point(cull_pattern_8)
punctured_slabs = Curve(cull_pattern_5)
punctures = Curve(circle_cnr)
tile_radii_4 = Integer(tile_radii_3)

# ----
simulated_time_2 = Integer(simulated_time)

# ---- group: Apportion planting type
plant_centers = Point(centers_with_gaps)
tree_random_seed = Number(random_seed)
of_trees_2 = Number(of_trees)
list_length_2 = ListLength(List=plant_centers)
random = Random(Range=Domain(0, 1), Number=list_length_2, Seed=tree_random_seed)
smaller_than = SmallerThan(FirstNumber=of_trees_2, SecondNumber=random)  # -> SmallerThan, OrEqualTo
larger_than_2 = LargerThan(FirstNumber=of_trees_2, SecondNumber=random)  # -> LargerThan, OrEqualTo

# ---- group: Make 3D Surface
punctured_slabs_cutouts = Curve(graft(punctures))
punctured_slab_perimeters = Curve(graft(punctured_slabs))
non_punctured_slabs_2 = Curve(non_punctured_slabs)
explode = Explode(Curve=non_punctured_slabs_2, Recursive=True)  # -> Segments, Vertices
boundary_surfaces = BoundarySurfaces(Edges=[punctured_slab_perimeters, punctured_slabs_cutouts])
list_item = ListItem(List=explode.Segments, Index=0, Wrap=True)
list_item_2 = ListItem(List=explode.Segments, Index=2, Wrap=True)
flip_curve = FlipCurve(Curve=list_item_2)  # -> Curve, Flag
loft = Loft(
    Curves=[flip_curve.Curve, list_item],
    Options={Adjust=False, Closed=False, LoftEnds=0, LoftSimp=0, LoftType=3, Rebuild=10, Refit=0.01})
custom_preview = CustomPreview(Geometry=[boundary_surfaces, loft], Shader=ColourSwatch(SwatchColor=RGB(112, 112, 112)))

# ---- group: Grass Planting
centers_4 = Point(centers_with_gaps)
generic_species_attributes = GenericSpeciesAttributes()  # -> Shrub, Grass, Tree
list_length_3 = ListLength(List=centers_4)
repeat_data = RepeatData(Data=generic_species_attributes.Grass, Length=list_length_3)
cull_pattern_9 = CullPattern(List=centers_4, CullPattern=smaller_than.SmallerThan)
cull_pattern_10 = CullPattern(List=repeat_data, CullPattern=smaller_than.SmallerThan)
plant_appearance_simulator = PlantAppearanceSimulator(Plants=cull_pattern_10, Locations=cull_pattern_9, Times=simulated_time_2)  # -> Trunk, Root, Crown, Spacing, Color, Label
boundary_surfaces_2 = BoundarySurfaces(Edges=plant_appearance_simulator.Crown)

# ----
split_argb = SplitARGB(Colour=plant_appearance_simulator.Color)  # -> Alpha, Red, Green, Blue
# While we could use the more simple Boundary Surface here to make the non-puncuted slabs, it is much slower than making a simple loft between the two parallel edges
colour_rgb_f = ColourRGBF(Alpha=0.5, Red=split_argb.Red, Green=split_argb.Green, Blue=split_argb.Blue)

# ---- group: Grass Planting (continued)
preview_canopies = CustomPreview(Geometry=boundary_surfaces_2, Shader=colour_rgb_f)

# ---- group: Tree Planting
simulated_time_3 = Integer(simulated_time)
centers_5 = Point(centers_with_gaps)
generic_species_attributes_2 = GenericSpeciesAttributes()  # -> Shrub, Grass, Tree
list_length_4 = ListLength(List=centers_5)
repeat_data_2 = RepeatData(Data=generic_species_attributes_2.Tree, Length=list_length_4)
cull_pattern_11 = CullPattern(List=centers_5, CullPattern=larger_than_2.LargerThan)
cull_pattern_12 = CullPattern(List=repeat_data_2, CullPattern=larger_than_2.LargerThan)
plant_appearance_simulator_2 = PlantAppearanceSimulator(Plants=cull_pattern_12, Locations=cull_pattern_11, Times=simulated_time_3)  # -> Trunk, Root, Crown, Spacing, Color, Label

# ----
split_argb_2 = SplitARGB(Colour=plant_appearance_simulator_2.Color)  # -> Alpha, Red, Green, Blue
boundary_surfaces_3 = BoundarySurfaces(Edges=plant_appearance_simulator_2.Crown)
# Note: the plant types presented here are not accurate to the as-built design/site — they are just used as rough indicators.
pie_chart = PieChart([cull_pattern_10, cull_pattern_12])
colour_rgb_f_2 = ColourRGBF(Alpha=0.33, Red=split_argb_2.Red, Green=split_argb_2.Green, Blue=split_argb_2.Blue)

# ---- group: Tree Planting (continued)
preview_canopies_2 = CustomPreview(Geometry=boundary_surfaces_3, Shader=colour_rgb_f_2)

# ==== cluster CreateGrid
C = ClusterInput()
sx = ClusterInput()
sy = ClusterInput()

# ---- group: Create bounds around roof
explode = Explode(Curve=C, Recursive=True)  # -> Segments, Vertices
bnd = Bounds2D(Coordinates=explode.Vertices)
dedom2num = DeconstructDomain²(Domain=bnd)  # -> UMin, UMax, VMin, VMax
pt = ConstructPoint(XCoordinate=dedom2num.UMin, YCoordinate=dedom2num.VMin, ZCoordinate=0)

# ----
subtraction = Subtraction(A=dedom2num.UMax, B=dedom2num.UMin)
subtraction_2 = Subtraction(A=dedom2num.VMax, B=dedom2num.VMin)
division = Division(A=subtraction, B=sx)
division_2 = Division(A=subtraction_2, B=sy)
recgrid = Rectangular(Plane=pt, SizeX=sx, SizeY=sy, ExtentX=division, ExtentY=division_2)  # -> flatten(Cells), Points
y = Integer(division_2)
x = Integer(division)
C_2 = ClusterOutput(recgrid.Cells)
x_2 = ClusterOutput(x)
y_2 = ClusterOutput(y)
