# Grasshopper definition Groundhog - Max IV Laboratory.ghx (Grasshopper 1.0.7)

# ---- group: Spiralled tangents
adjust_rotation = Slider(18.3, range=0..90)
tangent_count = Slider(32, range=0..100)
tangent_rotation = Slider(336, range=0..360)
adjust_rotation_2 = Number(adjust_rotation)
tangent_rotation_2 = Number(tangent_rotation)
tangent_count_2 = Number(tangent_count)

# ---- group: Landform parameters
# This Grasshopper definition and its corresponding Rhinoceros model were developed by Philip Belesky as part of the Groundhog project.
# 
# The definition and model are provided as speculative reverse-engineerings of how this landscape project could have been (partly) designed using computational methods. More information available at https://groundhog.philipbelesky.com/projects/max-iv-laboratory/
# 
# This definition depends on components from version v0.13.0 of the Groundhog plugin. It is available for download at http://groundhog.philipbelesky.com/plugin/
# The spiralled arcs follow and A/B pattern, where A creates a series of peaks and B a  series of valleys. Within an arc the peak/valley pattern follows a sin wave, defined by the min/max values here
number_slider = Slider(7, range=0..10)
mound_a_max_height = Number(number_slider)
mound_b_max_height = Number(Slider(3, range=0..10))
mound_b_min_height = Number(Slider(0, range=0..10))
mound_a_min_height = Number(Slider(3, range=0..10))

# ---- group: Straight line tangents
# The tangent arcs intersect with the spiralled arcs and define where exactly the peaks and valleys occur
number_slider_2 = Slider(225, range=0..360)
# Jump to graph mapper
# that defines the arc shape
# of the spirals
number_slider_3 = Slider(400, range=100..400)
tangent_rotation_3 = Number(number_slider_2)
tangent_extension = Number(number_slider_3)
tangent_count_3 = Number(Slider(40, range=0..100))

# ---- group: Define the inner ring of the landform around the building
# Groundhog Project File
landscape_perimeter = Curve(<curve referenced from the Rhino model>)

# ---- group: Create the straight line tangents radiating from the perimeter
landscape_perimeter_2 = Circle(landscape_perimeter)
tangent_count_4 = Number(tangent_count_3)
tangent_rotation_4 = Number(tangent_rotation_3)
tangent_extension_2 = Number(tangent_extension)
divide_curve = DivideCurve(Curve=landscape_perimeter_2, Count=expr("x*2", tangent_count_4), Kinks=False)  # -> Points, Tangents, Parameters
radians = Radians(Degrees=tangent_rotation_4)
xy_plane = XYPlane(Origin=Point(0, 0, 0))
rotate = Rotate(Vector=divide_curve.Tangents, Axis=xy_plane, Angle=radians)
multiplication = Multiplication(A=rotate, B=tangent_extension_2)
move = Move(Geometry=divide_curve.Points, Motion=multiplication)  # -> Geometry, Transform
line = Line(StartPoint=divide_curve.Points, EndPoint=move.Geometry)
straight_tangents = Line(line)

# ---- group: Adjust rotation of circle when creating the arced tangents
landscape_perimeter_3 = Curve(landscape_perimeter)
adjust_rotation_3 = Number(adjust_rotation_2)
area = Area(Geometry=landscape_perimeter_3)  # -> Area, Centroid
radians_2 = Radians(Degrees=adjust_rotation_3)
rotate_2 = Rotate(Geometry=landscape_perimeter_3, Angle=radians_2, Plane=area.Centroid)  # -> Geometry, Transform
landscape_perimeter_4 = Curve(rotate_2.Geometry)

# ---- group: Create counter rotated tangents to use as the spirals
tangent_extension_3 = Number(tangent_extension)
tangent_rotation_5 = Number(tangent_rotation_2)
landscape_perimeter_5 = Circle(landscape_perimeter_4)
tangent_count_5 = Number(tangent_count_2)
divide_curve_2 = DivideCurve(Curve=landscape_perimeter_5, Count=expr("x*2", tangent_count_5), Kinks=False)  # -> Points, Tangents, Parameters
radians_3 = Radians(Degrees=tangent_rotation_5)
xy_plane_2 = XYPlane(Origin=Point(0, 0, 0))
multiplication_2 = Multiplication(A=divide_curve_2.Tangents, B=tangent_extension_3)
rotate_3 = Rotate(Vector=multiplication_2, Axis=xy_plane_2, Angle=radians_3)
move_2 = Move(Geometry=divide_curve_2.Points, Motion=rotate_3)  # -> Geometry, Transform
line_2 = Line(StartPoint=divide_curve_2.Points, EndPoint=move_2.Geometry)
counter_tangents = Line(line_2)

# ---- group: Visualise straight tangents as high/low tangents
straight_tangents_a = Line(straight_tangents)
dispatch = Dispatch(List=straight_tangents_a, DispatchPattern=[True, False])  # -> ListA, ListB
antinodes_low = CustomPreview(Geometry=dispatch.ListB, Material=ColourSwatch(SwatchColor=RGB(212, 252, 255)))
nodes_high = CustomPreview(Geometry=dispatch.ListA, Material=ColourSwatch(SwatchColor=RGB(0, 255, 255)))

# ---- group: Create spiralled tangents from straight tangents by shifting their points along tangents according to a graph curve
exagerration = Slider(585, range=0..1000)
xy_plane_3 = XYPlane(Origin=Point(0, 0, 0))
counter_tangents_2 = Line(counter_tangents)
divide_curve_3 = DivideCurve(Curve=counter_tangents_2, Count="10", Kinks=False)  # -> Points, Tangents, Parameters
range = Range(Domain=Domain(0, 1), Steps="10")
curve_arc = GraphMapper(
    range,
    x0=0,
    x1=1,
    y0=0,
    y1=1,
    container_name="Bezier",
    cpx=[0, 0.5232381225, 0.6096048951, 1],
    cpy=[0.0292956233, 0.1060574651, 0.7677379251, 1])
cross_product = CrossProduct(VectorA=xy_plane_3, VectorB=divide_curve_3.Tangents, Unitize=True)  # -> simplify(Vector), Length
multiplication_3 = Multiplication(A=exagerration, B=curve_arc)
multiplication_4 = Multiplication(A=multiplication_3, B=cross_product.Vector)
move_3 = Move(Geometry=divide_curve_3.Points, Motion=multiplication_4)  # -> Geometry, Transform
interpolate = Interpolate(Vertices=move_3.Geometry, Degree=3, Periodic=False, KnotStyle=1)  # -> Curve, Length, Domain
curved_tangents = Curve(interpolate.Curve)

# ---- group: Intersect the straight and spiralled tangents; use intersections to determine the two different types of peak and valley
curved_tangents_2 = Curve(flatten(curved_tangents))
straight_tangents_2 = Line(straight_tangents)
dispatch_2 = Dispatch(List=curved_tangents_2, DispatchPattern=[True, False])  # -> ListA, ListB
dispatch_3 = Dispatch(List=straight_tangents_2, DispatchPattern=[True, False])  # -> ListA, ListB
high_curved_tangents = Curve(dispatch_2.ListB)
low_curved_tangents = Curve(dispatch_2.ListA)
high_straight_tangents = Curve(dispatch_3.ListA)
low_straight_tangents = Curve(dispatch_3.ListB)
curve_curve = CurveCurve(CurveA=high_straight_tangents, CurveB=graft(high_curved_tangents))  # -> Points, ParamsA, ParamsB
curve_curve_2 = CurveCurve(CurveA=low_straight_tangents, CurveB=graft(high_curved_tangents))  # -> Points, ParamsA, ParamsB
curve_curve_3 = CurveCurve(CurveA=low_straight_tangents, CurveB=graft(low_curved_tangents))  # -> Points, ParamsA, ParamsB
curve_curve_4 = CurveCurve(CurveA=high_straight_tangents, CurveB=graft(low_curved_tangents))  # -> Points, ParamsA, ParamsB
trim_tree = TrimTree(Tree=curve_curve_4.Points, Depth=1)
trim_tree_2 = TrimTree(Tree=curve_curve_2.Points, Depth=1)
trim_tree_3 = TrimTree(Tree=curve_curve_3.Points, Depth=1)
trim_tree_4 = TrimTree(Tree=curve_curve.Points, Depth=1)
valley_high_points = Point(trim_tree)
peak_high_points = Point(trim_tree_4)
valley_low_points = Point(trim_tree_3)
peak_low_points = Point(trim_tree_2)

# ---- group: Move the different types of peaks/valleys up by the amount specified, then group them back into the tangent arcs
peak_high_points_2 = Point(peak_high_points)
mound_b_min_height_2 = Number(mound_b_min_height)
mound_a_max_height_2 = Number(mound_a_max_height)
mound_b_max_height_2 = Number(mound_b_max_height)
peak_low_points_2 = Point(peak_low_points)
valley_low_points_2 = Point(valley_low_points)
valley_high_points_2 = Point(valley_high_points)
mound_a_min_height_2 = Number(mound_a_min_height)
unit_z = UnitZ(Factor=mound_a_max_height_2)
unit_z_2 = UnitZ(Factor=mound_a_min_height_2)
unit_z_3 = UnitZ(Factor=mound_b_min_height_2)
unit_z_4 = UnitZ(Factor=mound_b_max_height_2)
move_4 = Move(Geometry=valley_low_points_2, Motion=unit_z_3)  # -> Geometry, Transform
move_5 = Move(Geometry=valley_high_points_2, Motion=unit_z_4)  # -> Geometry, Transform
move_6 = Move(Geometry=peak_low_points_2, Motion=unit_z_2)  # -> Geometry, Transform
move_7 = Move(Geometry=peak_high_points_2, Motion=unit_z)  # -> Geometry, Transform
weave = Weave(Pattern=[0, 1], Stream0=move_4.Geometry, Stream1=move_5.Geometry, NullGaps=False)
weave_2 = Weave(Pattern=[0, 1], Stream0=move_7.Geometry, Stream1=move_6.Geometry, NullGaps=False)
peak_points = Point(weave_2)
valley_points = Point(weave)

# ---- group: Visualise nodes along the peak lines
cluster = Cluster(geometry=move_7.Geometry)  # -> point_2, line_2
cluster_2 = Cluster(geometry=move_6.Geometry)  # -> point_2, line_2
nodes_high_2 = CustomPreview(Geometry=[cluster.line_2, cluster.point_2], Material=ColourSwatch(SwatchColor=RGB(255, 0, 255)))
antinodes_low_2 = CustomPreview(Geometry=[cluster_2.point_2, cluster_2.line_2], Material=ColourSwatch(SwatchColor=RGB(255, 168, 255)))

# ---- group: The previous set of operations messes up the ordering of the points within each arc, so here we resort them according to distance from their origins and rebuild the spiralled curves
curved_tangents_3 = Curve(flatten(curved_tangents))
valley_points_2 = Point(valley_points)
peak_points_2 = Point(peak_points)
number_slider_4 = Slider(3, range=0..10)
sort_points = SortPoints(points=valley_points_2, curved_tangents=curved_tangents_3)
sort_points_2 = SortPoints(points=peak_points_2, curved_tangents=curved_tangents_3)
interpolate_2 = Interpolate(Vertices=sort_points_2, Degree=number_slider_4, Periodic=False, KnotStyle=1)  # -> Curve, Length, Domain
interpolate_3 = Interpolate(Vertices=sort_points, Degree=number_slider_4, Periodic=False, KnotStyle=2)  # -> Curve, Length, Domain
high_curved_tangents_2 = Curve(flatten(interpolate_2.Curve))
low_curved_tangents_2 = Curve(flatten(interpolate_3.Curve))
weave_3 = Weave(Pattern=[0, 1], Stream0=low_curved_tangents_2, Stream1=high_curved_tangents_2, NullGaps=False)
curved_tangents_4 = Curve(weave_3)

# ---- group: Visualise nodes along the valley lines
cluster_3 = Cluster(geometry=move_4.Geometry)  # -> point_2, line_2
cluster_4 = Cluster(geometry=move_5.Geometry)  # -> point_2, line_2
antinodes_low_3 = CustomPreview(Geometry=[cluster_4.point_2, cluster_4.line_2], Material=ColourSwatch(SwatchColor=RGB(212, 252, 255)))
nodes_high_3 = CustomPreview(Geometry=[cluster_3.line_2, cluster_3.point_2], Material=ColourSwatch(SwatchColor=RGB(0, 255, 255)))

# ---- group: Trim the arcs to a clean perimeter then loft them
curved_tangents_5 = Curve(curved_tangents_4)
landscape_perimeter_6 = Curve(landscape_perimeter)
area_2 = Area(Geometry=landscape_perimeter_6)  # -> Area, Centroid
scale = Scale(Geometry=landscape_perimeter_6, Center=area_2.Centroid, Factor=Slider(3.4, range=0..10))  # -> Geometry, Transform
scale_2 = Scale(Geometry=landscape_perimeter_6, Center=area_2.Centroid, Factor=Slider(1.03, range=0..10))  # -> Geometry, Transform
trim_with_region = TrimWithRegion(Curve=curved_tangents_5, Region=scale_2.Geometry)  # -> Inside, Outside
trim_with_region_2 = TrimWithRegion(Curve=trim_with_region.Outside, Region=scale.Geometry)  # -> Inside, Outside
loft = Loft(
    Curves=flatten(trim_with_region_2.Inside),
    Options={Adjust=False, Closed=True, LoftEnds=0, LoftSimp=1, LoftType=2, Rebuild=50, Refit=0.01})
landform = Surface(loft)

# ---- group: Visualise arced tangents as high/low tangents
curve = Curve(curved_tangents_4)
dispatch_4 = Dispatch(List=curve, DispatchPattern=[True, False])  # -> ListA, ListB
antinodes_low_4 = CustomPreview(Geometry=dispatch_4.ListB, Material=ColourSwatch(SwatchColor=RGB(255, 0, 255)))
nodes_high_4 = CustomPreview(Geometry=dispatch_4.ListA, Material=ColourSwatch(SwatchColor=RGB(255, 168, 255)))

# ----
landform_2 = Surface(landform)
custom_preview = CustomPreview(Geometry=landform_2, Material=ColourSwatch(SwatchColor=RGBA(74, 74, 74, 227)))

# ==== cluster SortPoints
points = ClusterInput()
curved_tangents = ClusterInput()
points_2 = Point(points)
curved_tangents_2 = Curve(flatten(curved_tangents))
dispatch = Dispatch(List=curved_tangents_2, DispatchPattern=[True, False])  # -> ListA, ListB
end_points = EndPoints(Curve=dispatch.ListA)  # -> Start, End
distance = Distance(PointA=points_2, PointB=graft(end_points.End))
sort_list = SortList(Keys=distance, ValuesValuesA=points_2)  # -> Keys, ValuesValuesA
points_3 = Point(sort_list.ValuesValuesA)
points_4 = ClusterOutput(points_3)

# ==== cluster Cluster
geometry = ClusterInput()
unit_z = UnitZ(Factor=Slider(10, range=0..10))
move = Move(Geometry=geometry, Motion=expr("x*-1", unit_z))  # -> Geometry, Transform
line = Line(StartPoint=geometry, EndPoint=move.Geometry)
point = Point(geometry)
point_2 = ClusterOutput(point)
line_2 = ClusterOutput(line)
