# Grasshopper definition Max IV Laboratory.gh (Grasshopper 1.0.4)

center_point = Point(<point referenced from the Rhino model>)
circle = CircleCNR(Center=center_point, Normal=Vector(0, 0, 1), Radius=Slider(110000, range=0..1000000))
divide = DivideCurve(Curve=circle, Count=Slider(40, range=0..100), Kinks=False)  # -> Points, Tangents, Parameters
xy = XYPlane(Origin=Point(0, 0, 0))
rad = Radians(Degrees=Slider(194, range=0..360))
vrot = Rotate(Vector=divide.Tangents, Axis=xy, Angle=rad)
multiplication = Multiplication(A=vrot, B=Slider(200000, range=100000..200000))
move = Move(Geometry=divide.Points, Motion=multiplication)  # -> Geometry, Transform
ln = Line(StartPoint=divide.Points, EndPoint=move.Geometry)
