# Grasshopper definition Groundhog - Sony Forest.ghx (Grasshopper 1.0.7)
# plug-ins: Groundhog

geometry_pipeline = GeometryPipeline(
    GroupByLayer=False,
    GroupByType=False,
    IncludeHidden=True,
    IncludeLocked=True,
    LayerFilter="*Building Volumes",
    NameFilter="*",
    SublayerFiltering=True,
    TypeFilter=1073741848)
geometry_pipeline_2 = GeometryPipeline(
    GroupByLayer=False,
    GroupByType=False,
    IncludeHidden=True,
    IncludeLocked=True,
    LayerFilter="*Other Buildings",
    NameFilter="*",
    SublayerFiltering=True,
    TypeFilter=1073741848)

# ----
# This Grasshopper definition and its corresponding Rhinoceros model were developed by Albert Rex and Philip Belesky as part of the Groundhog project.
# 
# The definition and model are provided as speculative reverse-engineerings of how this landscape project could have been (partly) designed using computational methods. More information available at https://www.groundhog.la/projects/sony-forest/
# 
# This definition depends on components from version v0.10.2b of the Groundhog plugin. It is available for download at http://groundhog.la/plugin/
# 
# It also uses components from Ladybug. That plugin is available for download at http://ladybug.tools
geometry_pipeline_3 = GeometryPipeline(
    GroupByLayer=False,
    GroupByType=False,
    IncludeHidden=True,
    IncludeLocked=True,
    LayerFilter="*Planting Attractors",
    NameFilter="*",
    SublayerFiltering=True,
    TypeFilter=1)
geometry_pipeline_4 = GeometryPipeline(
    GroupByLayer=False,
    GroupByType=False,
    IncludeHidden=True,
    IncludeLocked=True,
    LayerFilter="*Planting Attractors",
    NameFilter="*",
    SublayerFiltering=True,
    TypeFilter=1)
# Groundhog Project File
base_terrain_surface = Surface(<surface referenced from the Rhino model>)
planting_attractors = Point(geometry_pipeline_4)
paving_attractors = Point(geometry_pipeline_3)

paver_x_grid_spacing = Slider(3000, range=0..10000)
paver_y_grid_spacing = Slider(3000, range=0..10000)

building_volumes_context = Geometry(geometry_pipeline_2)
building_volumes = Geometry(geometry_pipeline)
simulated_time = Number(Slider(10, range=0..30))

# ---- group: Produce shading analysis of the site area
# To ensure the definition doesn't freeze on opening the full year-long shading analysis has been precalculated and internalised. To generate the analysis from scratch you'll Meed to Enable all the components to the left, change the date/time range, and rewire the results/mesh outputs.
# This is a very crude approximation of the "Environmental Analysis" stage described by ANS studio, which included further analysis of wind and soil suitability alongside various urban conditions.
# 
# Note also that this analysis has been limited to a very short term period and a very coarse grid size so the definition is quick to load.
# 
# Location data for the Tokyo site has been internalised into the sunPath component.
number_slider = Slider(3000, range=0..10000)
building_volumes_context_2 = Geometry(building_volumes_context)
base_terrain = Geometry(base_terrain_surface)
building_volumes_onsite = Geometry(building_volumes)
analysisperiod = Ladybug_AnalysisPeriod(fromMonth="1", fromDay="1", fromHour="1", toMonth="12", toDay="31", toHour="23")  # -> out, analysisPeriod; disabled; plug-in component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
ladybug = Ladybug_Ladybug()  # -> out; disabled; plug-in component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
sunpath = Ladybug_SunPath(
    location="""Site:Location,
Tokyo_Tokyo_JPN,
35.70000,      !Latitude
139.8000,     !Longitude
9.0,     !Time Zone
5.0;       !Elevation""",
    hour=12,
    day=21,
    month=12,
    timeStep=1,
    analysisPeriod=analysisperiod.analysisPeriod,
    dailyOrAnnualSunPath=True)  # -> out, sunVectors, sunAltitudes, sunAzimuths, port, sunSpheresMesh, sunPathCrvs, compassCrvs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; disabled; plug-in component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
sunlighthoursanalysis = Ladybug_SunlightHoursAnalysis(
    geometry=flatten(base_terrain),
    context=flatten([building_volumes_onsite, building_volumes_context_2]),
    gridSize=number_slider,
    disFromBase=Slider(1000, range=0..1000),
    sunVectors=flatten(sunpath.sunVectors),
    timeStep=1,
    parallel=Toggle(True),
    runIt=Toggle(True))  # -> out, contextMesh, analysisMesh, testPts, testVec, port, sunlightHoursResult, sunlightHoursMesh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; disabled; plug-in component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
sunlight_hours_precalculated = Number([1591, 1577, 1590, 1589, 1593, 1587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])
analysis_mesh_precalculated = Mesh(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)
sunlight_hours = Number(sunlight_hours_precalculated)
analysis_mesh = Mesh(analysis_mesh_precalculated)

# ---- group: Scatter Seeds
seed_count = Slider(2268, range=0..10000)
base_terrain_2 = Geometry(base_terrain_surface)
mesh = Mesh(base_terrain_2)
populate_geometry = PopulateGeometry(Geometry=mesh, Count=seed_count, Seed=1)
deconstruct = Deconstruct(Point=populate_geometry)  # -> XComponent, YComponent, ZComponent
construct_point = ConstructPoint(XCoordinate=deconstruct.XComponent, YCoordinate=deconstruct.YComponent, ZCoordinate=0)
seed_points = Point(construct_point)

# ---- group: Create seed clusters
planting_attractors_2 = Point(planting_attractors)
pull_factor = Slider(-1382, range=-10000..0)
seed_points_2 = Point(seed_points)
closest_point = ClosestPoint(Point=seed_points_2, Cloud=planting_attractors_2)  # -> ClosestPoint, CPIndex, Distance
larger_than = LargerThan(FirstNumber=Slider(10000, range=0..10000), SecondNumber=closest_point.Distance)  # -> LargerThan, OrEqualTo
cull_pattern = CullPattern(List=closest_point.ClosestPoint, CullPattern=larger_than.LargerThan)
cull_pattern_2 = CullPattern(List=seed_points_2, CullPattern=larger_than.LargerThan)
vector_2pt = Vector2Pt(PointA=cull_pattern, PointB=cull_pattern_2, Unitize=True)  # -> Vector, Length
multiplication = Multiplication(A=vector_2pt.Vector, B=pull_factor)
move = Move(Geometry=cull_pattern_2, Motion=multiplication)  # -> Geometry, Transform
seed_points_3 = Point(move.Geometry)

# ---- group: Divide up each surface using the predefined grid distance (won't be perfectly square; but good enough)
paver_y_grid_spacing_2 = Integer(paver_y_grid_spacing)
paver_x_grid_spacing_2 = Integer(paver_x_grid_spacing)
base_terrain_surface_2 = Surface(base_terrain_surface)
dimensions = Dimensions(Surface=base_terrain_surface_2)  # -> UDimension, VDimension
division = Division(A=dimensions.VDimension, B=paver_x_grid_spacing_2)
division_2 = Division(A=dimensions.UDimension, B=paver_y_grid_spacing_2)
mesh_surface = MeshSurface(Surface=base_terrain_surface_2, UCount=division_2, VCount=division, Overhang=True, Equalize=False)
flip_mesh = FlipMesh(Mesh=mesh_surface, VertexNormals=True, FaceNormals=True, FaceOrientation=True)
face_normals = FaceNormals(Mesh=flip_mesh)  # -> Centers, Normals
terrain_mesh_grid = Mesh(flip_mesh)
paving_origins = Point(face_normals.Centers)

# ---- group: Optimise Distances
minimum_seed_distance = Slider(735, range=0..10000)
seed_points_4 = Point(seed_points_3)
cull_duplicates = CullDuplicates(Points=seed_points_4, Tolerance=minimum_seed_distance, CullMode=3)  # -> Points, Indices, Valence
seed_points_5 = Point(cull_duplicates.Points)

# ---- group: Remove Seeds from Building Interiors
building_volumes_2 = Geometry(building_volumes)
seed_points_6 = Point(seed_points_5)
point_in_breps = PointInBreps(Brep=building_volumes_2, Point=seed_points_6, Strict=False)  # -> Inside, Index
cull_pattern_3 = CullPattern(List=seed_points_6, CullPattern=invert(point_in_breps.Inside))
seed_points_7 = Point(cull_pattern_3)

# ---- group: Match Seeds with Sunlight hours
analysis_mesh_2 = Mesh(analysis_mesh)
seed_points_8 = Point(seed_points_7)
sunlight_hours_2 = Number(sunlight_hours)
face_normals_2 = FaceNormals(Mesh=analysis_mesh_2)  # -> Centers, Normals
closest_point_2 = ClosestPoint(Point=seed_points_8, Cloud=face_normals_2.Centers)  # -> ClosestPoint, CPIndex, Distance
list_item = ListItem(List=sunlight_hours_2, Index=closest_point_2.CPIndex, Wrap=True)
light_hours_per_seed_point = Integer(list_item)

# ---- group: Make tiles
bounding_box = BoundingBox(Content=terrain_mesh_grid, Plane=PlaneXY(0, 0, 0), UnionBox=True)  # -> Box, Box_2
voronoi = Voronoi(Points=flatten([seed_points_7, paving_origins]), Boundary=bounding_box.Box, BruteForceOverride=False)
list_length = ListLength(List=paving_origins)
split_list = SplitList(List=voronoi, Index=list_length)  # -> ListA, ListB
unplanted = Geometry(split_list.ListA)
planted = Geometry(split_list.ListB)
custom_preview = CustomPreview(Geometry=planted, Material=ColourSwatch(SwatchColor=RGB(255, 255, 255)))

# ---- group: Classify seeds according to microclimate
light_hours_per_seed_point_2 = Integer(light_hours_per_seed_point)
seed_points_9 = Point(seed_points_7)
sort_list = SortList(Keys=light_hours_per_seed_point_2, ValuesValuesA=seed_points_9)  # -> Keys, ValuesValuesA
list_length_2 = ListLength(List=seed_points_9)
multiplication_2 = Multiplication(A=list_length_2, B=Slider(0.5, range=0..1))
split_list_2 = SplitList(List=sort_list.ValuesValuesA, Index=multiplication_2)  # -> ListA, ListB
bottom_50_light_conditiona = Point(split_list_2.ListA)
top_50_light_conditiona = Point(split_list_2.ListB)

# ----
shrub = ControlKnob(Decimals=0, Limit=True, Maximum=100, Minimum=0, Range=100, Value=8)
top_33_light_conditiona = Point(top_50_light_conditiona)
tree = ControlKnob(Decimals=0, Limit=True, Maximum=100, Minimum=0, Range=100, Value=49)
top_33_light_conditiona_2 = Point(bottom_50_light_conditiona)
tree_2 = ControlKnob(Decimals=0, Limit=True, Maximum=100, Minimum=0, Range=100, Value=11)
shrub_2 = ControlKnob(Decimals=0, Limit=True, Maximum=100, Minimum=0, Range=100, Value=43)
grass = ControlKnob(Decimals=0, Limit=True, Maximum=100, Minimum=0, Range=100, Value=41)
grass_2 = ControlKnob(Decimals=0, Limit=True, Maximum=100, Minimum=0, Range=100, Value=46)
species_proportions = SpeciesProportions_2(list=top_33_light_conditiona, B=shrub_2, B_2=grass_2, B_3=tree_2)
species_proportions_2 = SpeciesProportions(list=top_33_light_conditiona_2, B=shrub, B_2=grass, B_3=tree)
top_33_light_conditiona_3 = Point(top_33_light_conditiona_2)
top_33_light_conditions = Point(top_33_light_conditiona)
species = Data(species_proportions_2)
species_2 = Data(species_proportions)

# ---- group: Visualise solar analysis and plant canopies off to the side
unit_z = UnitZ(Factor=1)
simulated_time_2 = Number(simulated_time)
seed_locations = Point([top_33_light_conditiona_3, top_33_light_conditions])
seed_species = Data([species_2, species])
base_terrain_surface_3 = Surface(base_terrain_surface)
mesh_2 = Mesh(analysis_mesh)
mesh_ray = MeshRay(Mesh=base_terrain_surface_3, Point=seed_locations, Direction=unit_z)  # -> Point, Hit
unit_x = UnitX(Factor=Slider(200000, range=0..200000))
plant_appearance_canopy_mesh = PlantAppearanceCanopyMesh(Species=seed_species, Locations=mesh_ray.Point, Times=simulated_time_2)  # -> Canopies, Color, Label
move_2 = Move(Geometry=plant_appearance_canopy_mesh.Canopies, Motion=unit_x)  # -> Geometry, Transform
move_3 = Move(Geometry=mesh_2, Motion=unit_x)  # -> Geometry, Transform
custom_preview_2 = CustomPreview(Geometry=move_2.Geometry, Material=plant_appearance_canopy_mesh.Color)

# ---- group: Visualise discs on original site
seed_locations_2 = Point([top_33_light_conditiona_3, top_33_light_conditions])
seed_species_2 = Data([species_2, species])
plant_appearance_discs = PlantAppearanceDiscs(Species=seed_species_2, Locations=seed_locations_2, Times=simulated_time_2)  # -> Trunk, Root, Crown, Spacing, Color, Label
custom_preview_3 = CustomPreview(Geometry=[plant_appearance_discs.Trunk, plant_appearance_discs.Crown], Material=plant_appearance_discs.Color)

# ==== cluster SpeciesProportions
list = ClusterInput()
B = ClusterInput()
B_2 = ClusterInput()
B_3 = ClusterInput()

generic_species = GenericSpecies()  # -> ShrubS, GrassS, TreeS
list_length = ListLength(List=list)
division = Division(A=list_length, B=100)
multiplication = Multiplication(A=division, B=B)
multiplication_2 = Multiplication(A=division, B=B_2)
multiplication_3 = Multiplication(A=division, B=B_3)
repeat_data = RepeatData(Data=generic_species.ShrubS, Length=multiplication)
repeat_data_2 = RepeatData(Data=generic_species.GrassS, Length=multiplication_2)
repeat_data_3 = RepeatData(Data=generic_species.TreeS, Length=multiplication_3)
jitter = Jitter(List=[repeat_data, repeat_data_2, repeat_data_3], Jitter=1, Seed=2)  # -> Values, Indices
split_list = SplitList(List=jitter.Values, Index=list_length)  # -> ListA, ListB

list_a = ClusterOutput(split_list.ListA)

# ==== cluster SpeciesProportions_2
list = ClusterInput()
B = ClusterInput()
B_2 = ClusterInput()
B_3 = ClusterInput()
generic_species = GenericSpecies()  # -> ShrubS, GrassS, TreeS
list_length = ListLength(List=list)
division = Division(A=list_length, B=100)
multiplication = Multiplication(A=division, B=B)
multiplication_2 = Multiplication(A=division, B=B_2)
multiplication_3 = Multiplication(A=division, B=B_3)
repeat_data = RepeatData(Data=generic_species.ShrubS, Length=multiplication)
repeat_data_2 = RepeatData(Data=generic_species.GrassS, Length=multiplication_2)
repeat_data_3 = RepeatData(Data=generic_species.TreeS, Length=multiplication_3)
jitter = Jitter(List=[repeat_data, repeat_data_2, repeat_data_3], Jitter=1, Seed=2)  # -> Values, Indices
split_list = SplitList(List=jitter.Values, Index=list_length)  # -> ListA, ListB
list_a = ClusterOutput(split_list.ListA)
